# Grasshopper definition CsvReader.gh (Grasshopper 1.0.7)
# plug-ins: Bifocals, EleFront, Human UI

list = ValueList({"Point": 0, "Curve": 1, "Arc": 2, "Circle": 3, "Ellipse": 4, "Line": 5, "Polyline": 6, "Surface": 7, "Brep": 8, "Mesh": 9, "Polysurface": 10, "Block": 11, "Text": 12, "TextDot": 13, "Dimension": 14, "LinearDimension": 15, "AngularDimension": 16, "Hatch": 17, "Leader": 18}, selected="Block")
reftype = ReferenceByType(ObjectType=list)
list_2 = ValueList({"Point": 0, "Curve": 1, "Arc": 2, "Circle": 3, "Ellipse": 4, "Line": 5, "Polyline": 6, "Surface": 7, "Brep": 8, "Mesh": 9, "Polysurface": 10, "Block": 11, "Text": 12, "TextDot": 13, "Dimension": 14, "LinearDimension": 15, "AngularDimension": 16, "Hatch": 17, "Leader": 18}, selected="Brep")
deblock = DeconstructBlock(Block=reftype, recursive=True)  # -> Name, Plane, flatten(Geometry)
list_3 = ValueList({"Point": 0, "Curve": 1, "Arc": 2, "Circle": 3, "Ellipse": 4, "Line": 5, "Polyline": 6, "Surface": 7, "Brep": 8, "Mesh": 9, "Polysurface": 10, "Block": 11, "Text": 12, "TextDot": 13, "Dimension": 14, "LinearDimension": 15, "AngularDimension": 16, "Hatch": 17, "Leader": 18}, selected="Brep")
file_path = Panel("C:\CsvReader_data.csv")

# ----
# CLEAN DATA
# Fix data that is:
# -incorrect
# -innacurate
# -incomplete
# -irrelevant
# Define a point
pt = Point(Point(-267531.0742, -126877.2461, 0))

reftype_2 = ReferenceByType(ObjectType=list_2)
filtertype = FilterByType(Geometry=deblock.Geometry, ObjectType=list_3)
path = FilePath(file_path)
# TIDY DATA
# Organize data:
# - One variable per column
# - One entry per row
# - One purpose per table
merge = Merge(Data1=flatten(reftype_2), Data2=filtertype)
file = ReadFile(File=path, PerLineParse=True)
split_char = Panel(",")
rhatt = GetRhinoAttributes(Geometry=merge)  # -> Name, Layer, Color
split = TextSplit(Text=file, Separators=split_char)
txt = Text(rhatt.Layer)
flip = FlipMatrix(Data=split)
cset = CreateSet(List=txt)  # -> Set, Map
split_index = Panel("1")
split_2 = SplitList(List=flip, Index=split_index)  # -> simplify(ListA), simplify(ListB)
cset_2 = CreateSet(List=cset.Map)  # -> Set, Map
mindex = MemberIndex(Set=cset.Map, Member=cset_2.Set)  # -> Index, Count
layer_names = Panel(cset.Set)
item = ListItem(List=merge, Index=mindex.Index, Wrap=True)  # -> simplify(Item)
path_2 = ConstructPath(Indices="6")
path_3 = ConstructPath(Indices="5")
path_4 = ConstructPath(Indices="2")
path_5 = ConstructPath(Indices="4")
path_6 = ConstructPath(Indices="3")
path_7 = ConstructPath(Indices="0")
path_8 = ConstructPath(Indices="1")
lng = ListLength(List=layer_names)
clean = CleanTree(RemoveNulls=True, RemoveInvalid=True, RemoveEmpty=False, Tree=item)
branch = TreeBranch(Tree=split_2.ListB, Path=path_2, MaintainPaths=True)  # -> flatten(Branch)
lng_2 = ListLength(List=clean)
branch_2 = TreeBranch(Tree=split_2.ListB, Path=path_3, MaintainPaths=True)  # -> flatten(Branch)
branch_3 = TreeBranch(Tree=split_2.ListB, Path=path_4, MaintainPaths=True)  # -> flatten(Branch)
branch_4 = TreeBranch(Tree=split_2.ListB, Path=path_5, MaintainPaths=True)  # -> flatten(Branch)
branch_5 = TreeBranch(Tree=split_2.ListB, Path=path_6, MaintainPaths=True)  # -> flatten(Branch)
branch_6 = TreeBranch(Tree=split_2.ListB, Path=path_7, MaintainPaths=True)  # -> flatten(Branch)
branch_7 = TreeBranch(Tree=split_2.ListB, Path=path_8, MaintainPaths=True)  # -> flatten(Branch)
panel = Panel(clean)
random = Random(Range="0 to 255", Number=lng, Seed=250)
random_2 = Random(Range="0 to 255", Number=lng, Seed=2)
# Normally item 0 for each list the column title
panel_2 = Panel(split_2.ListA)
random_3 = Random(Range="0 to 255", Number=lng, Seed=52)
int = Integer(random_3)
int_2 = Integer(random_2)
int_3 = Integer(random)
num = Number(branch_2)
num_2 = Number(branch_4)
num_3 = Number(branch_5)
num_4 = Number(branch_6)
num_5 = Number(branch_7)
num_6 = Number(branch_3)
volume = Volume(Geometry=clean)  # -> Volume, Centroid
rgb = ColourRGB(Alpha=255, Red=int_2, Green=int, Blue=int_3)  # -> simplify(graft(Colour))
panel_3 = Panel(branch)
ma = MassAddition(Input=volume.Volume)  # -> Result, PartialResults
repeat = RepeatData(Data=rgb, Length=lng_2)
preview = CustomPreview(Geometry=item, Material=repeat)
tmatch = MatchText(Text=branch, RegEx=graft(layer_names), Case=False)
division = Division(A=ma.Result, B="1e9")
volumes = Panel(division)
panel_4 = Panel(tmatch)
cull = CullPattern(List=branch, CullPattern=tmatch)
keysearch = KeyValueSearch(Keys=branch, Values=num_5, Search=cull)
avr = Average(Input=keysearch)
multiplication = Multiplication(A=division, B=avr)
int_4 = Integer(multiplication)
panel_5 = Panel(cull)
panel_6 = Panel(avr)
ma_2 = MassAddition(Input=flatten(int_4))  # -> Result, PartialResults
panel_7 = Panel(keysearch)
panel_8 = Panel(int_4)
expression = Expression(x=int_4, Expression="format(\"{0}\",x)")
expression_2 = Expression(x=ma_2.Result, Expression="format(\"{0}\",x)")
# GWP ----> kg CO2        eq/m3
# ODP ----> μg R11        eq/m3
# POCP ---> g Ethene      eq/m3
# AP  ----> g SO2         eq
# EP  ----> g PO4(Phosphate)   eq/m3
concat = Concatenate(FragmentE="GWP ", FragmentA=flatten(layer_names), FragmentC=": ", FragmentB=flatten(expression), FragmentD=" kg CO2")
concat_2 = Concatenate(FragmentE="Total ", FragmentA=flatten("GWP "), FragmentC=": ", FragmentB=flatten(expression_2), FragmentD=" kg CO2")  # -> graft(Result)
panel_9 = Panel(concat_2)
panel_10 = Panel(concat)
rgb_2 = ColourRGB(Alpha=255, Red=0, Green=0, Blue=0)
ins = InsertItems(List=flatten(rgb), Item=rgb_2, Indices=-1, Wrap=True)
ins_2 = InsertItems(List=panel_10, Item=panel_9, Indices=-1, Wrap=True)
lng_3 = ListLength(List=ins_2)
pdecon = Deconstruct(Point=pt)  # -> XComponent, YComponent, ZComponent
series = Series(Start=pdecon.YComponent, Step=Slider(15, range=0..15, expression="-(x*100)"), Count=lng_3)
pt_2 = ConstructPoint(XCoordinate=pdecon.XComponent, YCoordinate=series, ZCoordinate=pdecon.ZComponent)
tag = TextTag3D(Location=pt_2, Text=ins_2, Size="1000", Colour=ins, Justification=7)

# ----
# FORM VIEW
number_slider = Slider(221, range=0..1000)
mesh_sphere = MeshSphere(Base=PlaneXY(0, 0, 0), Radius=10, UCount=10, VCount=20)
create_3d_view = Create3DView(MeshToDisplay=mesh_sphere, MeshColors=RGB(255, 0, 0), ViewWidth=number_slider, ViewHeight=Slider(324, range=0..1000))
set_3d_view = Set3DView(_3DView=create_3d_view, MeshColors=ColourSwatch(SwatchColor=RGBA(247, 242, 242, 65)))
adjust_element_positioning = AdjustElementPositioning(
    ElementsToAdjust=create_3d_view,
    Margin="0,0,0,0",
    AbsolutePositioning=False,
    Width=Slider(432, range=0..1000),
    Height=Slider(325, range=0..1000))

# ----
# CHART FOR AREAS
brep = Brep()
area = Area(Geometry=brep)  # -> simplify(flatten(Area)), Centroid
partition_list = PartitionList(List=area.Area, Size=[3, 2])
mass_addition = MassAddition(Input=partition_list)  # -> Result, PartialResults
number = Number(flatten(mass_addition.Result))
create_chart = CreateChart(Data=flatten(panel_8), Names=flatten(layer_names), Title="FLOOR AREA VARIATIONS", SubTitle="SQUARE METERS", ChartType=3)
set_chart_contents = SetChartContents(ChartToModify=create_chart, NewChartValues=number)
chart_appearance = ChartAppearance(
    ChartToModify=create_chart,
    Colors=[ColourSwatch(SwatchColor=RGB(242, 170, 170)), ColourSwatch(SwatchColor=RGB(171, 53, 53)), ColourSwatch(SwatchColor=RGB(92, 60, 60)), ColourSwatch(SwatchColor=RGB(252, 28, 28))],
    Title=True)

adjust_element_positioning_2 = AdjustElementPositioning(ElementsToAdjust=create_chart, Margin="0,0,0,0", AbsolutePositioning=False)
merge_2 = Merge(Data1=create_chart, Data2=create_3d_view)  # -> flatten(Result)
# Impact
# Arial
# Segoe UI
# Calibri
# Verdana
# Minion Pro
# Rosewood Std
# Tw Cen MT
number_slider_2 = Slider(918, range=0..1000)
launch_window = LaunchWindow(
    Show=Toggle(False),
    Name="Control Window",
    Width=Slider(1343, range=0..2000),
    Height=number_slider_2,
    FontFamily="Arial",
    ChildStatus=2,
    EnableHorizScroll=False)
panel_11 = Panel("""0
0
0
1
1
1
2
2
2""")
accent_colors = ValueList({"Amber", "Blue", "Brown", "Cobalt", "Crimson", "Cyan", "Emerald", "Green", "Indigo", "Lime", "Magenta", "Mauve", "Olive", "Orange", "Pink", "Purple", "Red", "Sienna", "Steel", "Taupe", "Teal", "Violet", "Yellow"}, selected="Crimson")
swatch = White(SwatchColor=RGB(255, 255, 255))
panel_12 = Panel("""0
1
2
0
1
2
0
1
2""")
set_window_properties = SetWindowProperties(
    Window=launch_window,
    Theme=Slider(0, range=0..1),
    AccentColor=accent_colors,
    ShowTitleBar=Toggle(True),
    BackgroundColor=swatch,
    ScaleFactor=1)
file_path_2 = FilePath("C:\Users\Admin\Desktop\first sheet.png")
create_grid = CreateGrid(
    UIElements=merge_2,
    Width=Slider(5704, range=0..10000),
    Height=Slider(6001, range=0..10000),
    RowDefinitions=[Slider(370, range=0..1000), Slider(347, range=0..1000), Slider(67, range=0..1000)],
    ColumnDefinitions=[Slider(492, range=0..1000), Slider(517, range=0..1000), Slider(576, range=0..1000)],
    ElementRow=panel_11,
    ElementColumn=panel_12,
    ElementRowSpan=1,
    ElementColumnSpan=1)
add_elements = AddElements(Window=launch_window, Elements=flatten(create_grid), DoVLChecking=True)  # -> AddedElements, ElementNames
capture_window_or_element_to_file = CaptureWindowOrElementToFile(
    WindowOrElement=launch_window,
    FilePath=file_path_2,
    ScaleFactor=Slider(10, range=0..10),
    Run=Toggle(False),
    CaptureEntireWindow=Toggle(False))
adjust_element_positioning_3 = AdjustElementPositioning(
    ElementsToAdjust=create_grid,
    Margin="30,30,0,0",
    AbsolutePositioning=False,
    Width=Slider(1564, range=0..2000),
    Height=Slider(802, range=0..2000))
