# Grasshopper definition Elefront_values.gh (Grasshopper 1.0.7)
# plug-ins: EleFront, Bifocals

parameter_names = Panel("""R_Department
R_Sub_Department
R_Function
R_Typical
R_Program_Number
R_Number
R_Name
R_Program_Area
R_Program_Height
R_Program_Access_Width
R_OccupancyNumber
R_Attendance_Time
R_Containment_Level
R_AcousticRating
R_Vibration
R_Liquids
R_Gas
R_Electromagnetic_Field""")
values = Panel("""QUANTUM OPTICS CRYOSTAT
2.10 MODULE 1
QUANTUM CIRCUITS
QOC_O
2.10.1.a
2.10.01_01
Lab Module
76
4
2x2.4m

ISO 7
NC - 30
VC-C
Azote liquide
	Air comprimé/Récupération hélium /Azote/Cylinder gas manifold
300nT p-p""")
extgeo = ExtendedGeometry(<brep referenced from the Rhino model>)
getatt = GetElefrontAttributes(Geometry=extgeo)
attributes = DefineObjectAttributes(UserKeys=parameter_names, UserValues=values)
panel = Panel(getatt)
