# Grasshopper definition Galapagos_01_GenD.gh (Grasshopper 1.0.7)
# plug-ins: Bifocals

# ----
# Doubleclick Me!
crv = Curve(<curve referenced from the Rhino model>)
join = JoinCurves(Curves=crv, Preserve=False)

genes = GenePool(Decimals=4, Maximum=100, Minimum=0, Value=[0.5468, 7.5375, 99.9437])

item = ListItem(List=genes, Index=2, Wrap=True)
item_2 = ListItem(List=genes, Index=1, Wrap=True)
item_3 = ListItem(List=genes, Index=0, Wrap=True)
division = Division(A=item_2, B="100")
division_2 = Division(A=item, B="100")
remap = RemapNumbers(Value=item_3, Source="0 to 100", Target="20000 to 50000")  # -> Mapped, Clipped
pt = ConstructPoint(XCoordinate=division, YCoordinate=division_2, ZCoordinate=0)
division_3 = Division(A=remap.Mapped, B=2)

neg = Negative(Value=division_3)
offset = OffsetCurve(Curve=join, Distance=neg, Corners=1)
srf = Surface(offset)
evalsrf = EvaluateSurface(Surface=reparameterize(srf), Point=pt)  # -> Point, Normal, UDirection, VDirection, Frame
dom = ConstructDomain(DomainStart=division_3, DomainEnd=expr("x*-1", division_3))
rectangle = Rectangle(Plane=evalsrf.Point, XSize=dom, YSize=dom, Radius=0)  # -> Rectangle, Length

multiplication = Multiplication(A=division_3, B=division_3)
division_4 = Division(A=multiplication, B="1000000")
max_area = Panel("5000000")
division_5 = Division(A=max_area, B=division_4)

preview = CustomPreview(Geometry=offset, Material=ColourSwatch(SwatchColor=RGB(250, 0, 0)))
number_slider = Slider(3500, range=0..10000)
Z = UnitZ(Factor=division_5)
division_6 = Division(A=division_5, B=number_slider)
extr = Extrude(Base=rectangle.Rectangle, Direction=Z)
cap = CapHoles(Brep=extr)
round = Round(Number=division_6)  # -> Nearest, Floor, Ceiling
multiplication_2 = Multiplication(A=round.Floor, B=number_slider)
preview_2 = CustomPreview(Geometry=cap, Material=ColourSwatch(SwatchColor=RGBA(0, 250, 96, 114)))
dom_2 = ConstructDomain(DomainStart=0, DomainEnd=multiplication_2)
range = Range(Domain=dom_2, Steps=round.Floor)
Z_2 = UnitZ(Factor=range)

move = Move(Geometry=evalsrf.Point, Motion=Z_2)  # -> Geometry, Transform
X = UnitX(Factor=1)
Z_3 = UnitZ(Factor=1)
range_2 = Range(Domain="0 to 350", Steps="50")
vrot = Rotate(Vector=X, Axis=Z_3, Angle=range_2)
line = LineSDL(Start=graft(move.Geometry), Direction=vrot, Length="300000")

brep = Brep([<brep referenced from the Rhino model> x7])
mesh = Mesh(brep)
mjoin = MeshJoin(Meshes=mesh)

preview_3 = CustomPreview(Geometry=brep, Material=ColourSwatch(SwatchColor=RGBA(79, 227, 205, 114)))
meshray = MeshRay(Mesh=mjoin, Point=graft(move.Geometry), Direction=vrot)  # -> Point, Hit
not = GateNot(A=meshray.Hit)
cull = CullPattern(List=line, CullPattern=not)
lng = ListLength(List=cull)  # -> flatten(Length)
ma = MassAddition(Input=lng)  # -> Result, PartialResults
panel = Panel(ma.Result)
galapagos = Galapagos(fitness=num, gene=genes)
num = Number(ma.Result)
