# Grasshopper definition Gh_001_LadyBug.gh (Grasshopper 1.0.7)
# plug-ins: Bifocals, EleFront

# ----
# 2. Import EPW data
# Checking / Output
# RGB 251,225,200
# 
# Orange indicates checking nodes to ensure te script has deployed correctly
# Important stuff
panel = Panel("https://energyplus-weather.s3.amazonaws.com/europe_wmo_region_6/NLD/NLD_Amsterdam.062400_IWEC/NLD_Amsterdam.062400_IWEC.zip")
downloadepw = LBDownloadWeather(weather_URL=panel)  # -> epw_file, stat_file, ddy_file; plug-in component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
importepw = LBImportEPW(epw_file=downloadepw.epw_file)  # -> location, dry_bulb_temperature, dew_point_temperature, relative_humidity, wind_speed, wind_direction, direct_normal_rad, diffuse_horizontal_rad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; plug-in component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

# ----
# 3b. Specify date - period values
month = Slider(6, range=1..12)
day = Slider(21, range=1..31)
hour = Slider(1, range=0..24)
month_2 = Slider(6, range=1..12)
day_2 = Slider(21, range=1..31)
hour_2 = Slider(23, range=0..24)
analysisperiod = LBAnalysisPeriod(start_month=month, start_day=day, start_hour=hour, end_month=month_2, end_day=day_2, end_hour=hour_2)  # -> period, hoys, dates; plug-in component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

# ----
# Variables / Inputs
# 1.True to Open Map selection
# RGB 251,217,233
# 
# Red indicates Variables that can be altered per project and must be set accordingly before running the script
# Working / Functions
# RGB 217,249,236
# 
# Green indicates the working part of the script. No changes should be made in these groups unless advised.
toggle = BooleanToggle(False)
epwmap = LBEPWmap(epw_map=toggle)  # -> report; plug-in component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

# ----
# 4. Geometry Project input
building_centroid_pt = Point(Point(-26221.89285, 25807.68661, 0))
geometry_to_be_checked = ExtendedGeometry([<brep referenced from the Rhino model> x5000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])
offse_height = Slider(50, range=0..1000)
context_geometry = Brep(<brep referenced from the Rhino model>)
angle_to_true_north = Panel("0")
grid_size = Panel("500")

# ----
# 3a. Specify Date
day_3 = Slider(21, range=1..31)
hour_3 = Slider(8, range=0..24)
# RGB 218,193,225
# 
# Orange indicates checking nodes to ensure te script has deployed correctly
month_3 = Slider(6, range=1..12)
hoy = LBCalculateHOY(month=month_3, day=day_3, hour=hour_3)  # -> flatten(hoy), flatten(doy), flatten(date); plug-in component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

# ----
# 5.Text tag Input
tag_location_pt = Point(Point(10299.04043, 1757.494531, 0))
tag_text_size = Panel("1000")

# ----
# Filter useful geometry
list = ValueList({"Point": 0, "Curve": 1, "Arc": 2, "Circle": 3, "Ellipse": 4, "Line": 5, "Polyline": 6, "Surface": 7, "Brep": 8, "Mesh": 9, "Polysurface": 10, "Block": 11, "Text": 12, "TextDot": 13, "Dimension": 14, "LinearDimension": 15, "AngularDimension": 16, "Hatch": 17, "Leader": 18}, selected="Block")
list_2 = ValueList({"Point": 0, "Curve": 1, "Arc": 2, "Circle": 3, "Ellipse": 4, "Line": 5, "Polyline": 6, "Surface": 7, "Brep": 8, "Mesh": 9, "Polysurface": 10, "Block": 11, "Text": 12, "TextDot": 13, "Dimension": 14, "LinearDimension": 15, "AngularDimension": 16, "Hatch": 17, "Leader": 18}, selected="Brep")
filtertype = FilterByType(Geometry=context_geometry, ObjectType=list)
filtertype_2 = FilterByType(Geometry=context_geometry, ObjectType=list_2)
deblock = DeconstructBlock(Block=filtertype)  # -> Name, Plane, Geometry
merge = Merge(Data1=flatten(filtertype_2), Data2=flatten(deblock.Geometry))

# ----
# Update Legend!
number_slider = Slider(1, range=0..10)
colrange = LBColorRange(index=number_slider)  # -> colors; plug-in component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
legendpar = LBLegendParameters(colors=colrange)  # -> leg_par; plug-in component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

# ----
# SunPath
sunpath_scale = Panel("2")
sunpath = LBSunPath(
    north=angle_to_true_north,
    location=importepw.location,
    hoys=analysisperiod.hoys,
    center_pt=building_centroid_pt,
    scale=sunpath_scale)  # -> report, vectors, altitudes, azimuths, hoys, sun_pts, analemma, daily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; plug-in component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

# ----
# SkyMatrix
skymatrix = LBCumulativeSkyMatrix(
    north=angle_to_true_north,
    location=importepw.location,
    direct_rad=importepw.direct_normal_rad,
    diffuse_rad=importepw.diffuse_horizontal_rad,
    hoys=analysisperiod.hoys)  # -> report, sky_mtx; disabled; plug-in component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

# ----
# WindRose
windrose = LBWindRose(
    north=angle_to_true_north,
    data=importepw.wind_speed,
    wind_direction=importepw.wind_direction,
    center_pt=building_centroid_pt,
    period=analysisperiod.period)  # -> report, mesh, compass, orient_line, freq_line, windrose_line, legend, title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; disabled; plug-in component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

# ----
# View Rose
number_slider_2 = Slider(250000, range=0..300000)
viewrose = Ladybug_viewRose(context=merge, plane=building_centroid_pt, radius=number_slider_2)  # -> readMe, viewRose, blocked, visibleAngle; disabled; plug-in component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

# ----
# B.SkyDome
skydome_scale = Panel("2")
skydome = LBSkyDome(sky_mtx=skymatrix.sky_mtx, center_pt=building_centroid_pt, scale=skydome_scale)  # -> report, mesh, compass, legend, title, patch_vecs, patch_values, mesh_values; disabled; plug-in component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

# ----
# Filter useful geometry
list_3 = ValueList({"Point": 0, "Curve": 1, "Arc": 2, "Circle": 3, "Ellipse": 4, "Line": 5, "Polyline": 6, "Surface": 7, "Brep": 8, "Mesh": 9, "Polysurface": 10, "Block": 11, "Text": 12, "TextDot": 13, "Dimension": 14, "LinearDimension": 15, "AngularDimension": 16, "Hatch": 17, "Leader": 18}, selected="Brep")
list_4 = ValueList({"Point": 0, "Curve": 1, "Arc": 2, "Circle": 3, "Ellipse": 4, "Line": 5, "Polyline": 6, "Surface": 7, "Brep": 8, "Mesh": 9, "Polysurface": 10, "Block": 11, "Text": 12, "TextDot": 13, "Dimension": 14, "LinearDimension": 15, "AngularDimension": 16, "Hatch": 17, "Leader": 18}, selected="Block")
filtertype_3 = FilterByType(Geometry=geometry_to_be_checked, ObjectType=list_4)
filtertype_4 = FilterByType(Geometry=geometry_to_be_checked, ObjectType=list_3)
deblock_2 = DeconstructBlock(Block=filtertype_3)  # -> Name, Plane, Geometry

filtertype_5 = FilterByType(Geometry=deblock_2.Geometry, ObjectType=list_3)

merge_2 = Merge(Data1=flatten(filtertype_4), Data2=flatten(filtertype_5))

clean = CleanTree(RemoveNulls=True, RemoveInvalid=True, RemoveEmpty=False, Tree=merge_2)

# ----
# View Percent on Geometry
number_slider_3 = Slider(0, range=0..4)
viewpercent = LBViewPercent(
    view_type=number_slider_3,
    geometry=flatten(merge_2),
    context=flatten(merge),
    grid_size=grid_size,
    offset_dist=offse_height,
    legend_par=legendpar,
    run=Toggle(False))  # -> report, points, view_vecs, results, mesh, legend, title, int_mtx; disabled; plug-in component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

# ----
# A.Direct Sun Hours on Geometry
toggle_2 = BooleanToggle(True)
directsunhours = LBDirectSunHours(
    vectors=flatten(sunpath.vectors),
    geometry=flatten(clean),
    context=flatten(merge),
    grid_size=grid_size,
    offset_dist=offse_height,
    legend_par=legendpar,
    run=toggle_2)  # -> report, points, results, mesh, legend, title, int_mtx; plug-in component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
ma = MassAddition(Input=directsunhours.results)  # -> Result, PartialResults

# ----
# Incident Radiation on Geometry
toggle_3 = BooleanToggle(False)
incidentradiation = LBIncidentRadiation(
    sky_mtx=skymatrix.sky_mtx,
    geometry=flatten(merge_2),
    context=flatten(merge),
    grid_size=grid_size,
    offset_dist=offse_height,
    legend_par=legendpar,
    run=toggle_3)  # -> report, points, results, total, mesh, legend, title, int_mtx; disabled; plug-in component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

# ----
# Extract Some Data
panel_2 = Panel("Average sun hours: ")
lng = ListLength(List=directsunhours.points)  # -> flatten(Length)
division = Division(A=ma.Result, B=lng)
concat = Concatenate(FragmentA="Number of analyzed points: ", FragmentB=lng)
concat_2 = Concatenate(FragmentA=panel_2, FragmentB=division)
concat_3 = Concatenate(FragmentA="Total sun hours: ", FragmentB=ma.Result)
Y = UnitY(Factor=tag_text_size)
Y_2 = UnitY(Factor=tag_text_size)
move = Move(Geometry=tag_location_pt, Motion=expr("-2*x", Y))  # -> Geometry, Transform
move_2 = Move(Geometry=move.Geometry, Motion=expr("-2*x", Y_2))  # -> Geometry, Transform

# ----
# Output!
tag = TextTag3D(Location=tag_location_pt, Text=concat, Size=tag_text_size, Justification=7)
tag_2 = TextTag3D(Location=move.Geometry, Text=concat_3, Size=tag_text_size, Justification=7)
tag_3 = TextTag3D(Location=move_2.Geometry, Text=concat_2, Size=tag_text_size, Justification=7)
output = Geometry([directsunhours.mesh, directsunhours.legend, directsunhours.title])
