# Grasshopper definition Gh_001_LadyBug_2D Diagrams.gh (Grasshopper 1.0.7)
# plug-ins: Bifocals

# ----
# https://climate.onebuilding.org/WMO_Region_6_Europe/ITA_Italy/index.html
# Variables / Inputs
# 1.True to Open Map selection
# RGB 251,217,233
# 
# Red indicates Variables that can be altered per project and must be set accordingly before running the script
# Working / Functions
# RGB 217,249,236
# 
# Green indicates the working part of the script. No changes should be made in these groups unless advised.
# Checking / Output
# RGB 251,225,200
# 
# Orange indicates checking nodes to ensure te script has deployed correctly
toggle = BooleanToggle(False)
epwmap = LBEPWmap(epw_map=toggle)  # -> report; plug-in component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

# ----
# 2. Import EPW data
# Important stuff
# RGB 218,193,225
# 
# Orange indicates checking nodes to ensure te script has deployed correctly
path = FilePath("\\kaansrv02\userhomedata$\jcuartero\Desktop\New folder (2)\ITA_ER_Bologna-Marconi.AP.161400_TMYx.2007-2021.epw")
importepw = LBImportEPW(epw_file=path)  # -> location, dry_bulb_temperature, dew_point_temperature, relative_humidity, wind_speed, wind_direction, direct_normal_rad, diffuse_horizontal_rad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; plug-in component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

colrange = LBColorRange(index=Slider(1, range=0..5))  # -> colors; plug-in component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
data = Data(importepw.wind_direction)
xdata = LBDeconstructData(data=data)  # -> simplify(header), simplify(values); plug-in component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
pt = Point(Point(0, 0, 0))
panel = Panel(xdata.values)
panel_2 = Panel(xdata.header)
bang = ExplodeTree(Data=xdata.values)
pt_2 = Point(Point(370610.1972, -17385.31454, 0))
bnd = Bounds(Numbers=bang)
legendpar = LBLegendParameters(colors=colrange, text_height="50")  # -> leg_par; plug-in component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

# ----
# Windrose
number_slider = Slider(0, range=-180..180)
windrose = LBWindRose(north=number_slider, data=importepw.wind_speed, wind_direction=importepw.wind_direction, legend_par=legendpar)  # -> report, mesh, compass, orient_line, freq_line, windrose_line, legend, title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; plug-in component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

# ----
# Use for ground temperature
panel_3 = Panel("30000")
monthlychart = LBMonthlyChart(data=data, base_pt=pt, x_dim=panel_3, y_dim="90000", legend_par=legendpar)  # -> report, data_mesh, data_lines, col_lines, legend, borders, labels, y_title, title, vis_set; disabled; plug-in component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

hourlyplot = LBHourlyPlot(data=data, base_pt=pt, legend_par=legendpar)  # -> report, mesh, legend, borders, labels, title, vis_set; plug-in component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
avr = Average(Input=xdata.values)
dedomain = DeconstructDomain(Domain=bnd)  # -> Start, End

concat = Concatenate(FragmentA="Prevailing Wind direction (in degrees): ", FragmentB=windrose.prevailing)

round = Round(Number=avr)  # -> Nearest, Floor, Ceiling
pt_3 = Point(Point(-85008.17995, -170050.2273, 0))

panel_4 = Panel(dedomain.End)
panel_5 = Panel(dedomain.Start)
concat_2 = Concatenate(FragmentA="Min value:", FragmentB=panel_5)
concat_3 = Concatenate(FragmentA="Avg value:", FragmentB=round.Nearest)
concat_4 = Concatenate(FragmentA="Max value:", FragmentB=panel_4)
Y = UnitY(Factor="50")
move = Move(Geometry=pt_2, Motion=expr("x*-150", Y))  # -> Geometry, Transform
move_2 = Move(Geometry=move.Geometry, Motion=expr("x*-150", Y))  # -> Geometry, Transform

# ----
# Bake me!
tag = TextTag3D(Location=pt_3, Text=concat, Size="50", Justification=7)
geo = Geometry([windrose.mesh, windrose.compass, windrose.orient_line, windrose.freq_line, windrose.windrose_line, windrose.legend, windrose.title])

geo_2 = Geometry([hourlyplot.mesh, hourlyplot.legend, hourlyplot.labels, hourlyplot.title])
tag_2 = TextTag3D(Location=move_2.Geometry, Text=concat_3, Size="50", Justification=7)
tag_3 = TextTag3D(Location=move.Geometry, Text=concat_4, Size="50", Justification=7)
# Bake me!
tag_4 = TextTag3D(Location=pt_2, Text=concat_2, Size="50", Justification=7)
