# Grasshopper definition Gh_003_LadyBug_Interior_DaylightSun.gh (Grasshopper 1.0.7)
# plug-ins: Bifocals, EleFront

# ----
# Variables / Inputs
# RGB 251,217,233
# 
# Red indicates Variables that can be altered per project and must be set accordingly before running the script
# Load Weather in!
# Working / Functions
# RGB 217,249,236
# 
# Green indicates the working part of the script. No changes should be made in these groups unless advised.
panel = Panel("https://energyplus-weather.s3.amazonaws.com/europe_wmo_region_6/NLD/NLD_Amsterdam.062400_IWEC/NLD_Amsterdam.062400_IWEC.zip")
downloadepw = LBDownloadWeather(weather_URL=panel)  # -> epw_file, stat_file, ddy_file; plug-in component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
wea = HBWeaFromEPW(epw_file=downloadepw.epw_file)  # -> wea; plug-in component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

# ----
# Specify a Period for Analysis
# Checking / Output
# RGB 251,225,200
# 
# Orange indicates checking nodes to ensure te script has deployed correctly
number_slider = Slider(6, range=1..12)
# Important stuff
# RGB 218,193,225
# 
# Orange indicates checking nodes to ensure te script has deployed correctly
number_slider_2 = Slider(23, range=1..23)
analysisperiod = LBAnalysisPeriod(
    start_month=number_slider,
    start_day=Slider(21, range=1..31),
    start_hour=Slider(1, range=1..23),
    end_month=Slider(6, range=1..12),
    end_day=Slider(21, range=1..31),
    end_hour=number_slider_2)  # -> period, hoys, dates; plug-in component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

# ----
# Inputs
rooms = Brep(<brep referenced from the Rhino model>)
glazing = Brep([<brep referenced from the Rhino model> x6])
extgeo = ExtendedGeometry(<brep referenced from the Rhino model>)

list = ValueList({"Point": 0, "Curve": 1, "Arc": 2, "Circle": 3, "Ellipse": 4, "Line": 5, "Polyline": 6, "Surface": 7, "Brep": 8, "Mesh": 9, "Polysurface": 10, "Block": 11, "Text": 12, "TextDot": 13, "Dimension": 14, "LinearDimension": 15, "AngularDimension": 16, "Hatch": 17, "Leader": 18}, selected="Brep")
list_2 = ValueList({"Point": 0, "Curve": 1, "Arc": 2, "Circle": 3, "Ellipse": 4, "Line": 5, "Polyline": 6, "Surface": 7, "Brep": 8, "Mesh": 9, "Polysurface": 10, "Block": 11, "Text": 12, "TextDot": 13, "Dimension": 14, "LinearDimension": 15, "AngularDimension": 16, "Hatch": 17, "Leader": 18}, selected="Block")
filtertype = FilterByType(Geometry=extgeo, ObjectType=list)
filtertype_2 = FilterByType(Geometry=extgeo, ObjectType=list_2)
deblock = DeconstructBlock(Block=filtertype_2)  # -> Name, Plane, Geometry
merge = Merge(Data1=flatten(filtertype), Data2=flatten(deblock.Geometry))
clean = CleanTree(RemoveNulls=True, RemoveInvalid=True, RemoveEmpty=False, Tree=merge)

shade = HBShade(geo=clean)  # -> report, shades; plug-in component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

roomsolid = HBRoomFromSolid(geo=flatten(rooms), name="room 2", conditioned=True)  # -> report, rooms; plug-in component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
room = HBRoom(conditioned=True)  # -> report, room; plug-in component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

aperture = HBAperture(geo=glazing)  # -> report, apertures; plug-in component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

# ----
# If you want to add louvers to the openings
number_slider_3 = Slider(5, range=0..10)
louvershades = HBLouverShades(hb_objs=flatten(aperture.apertures), depth=Slider(100, range=0..100), shade_count=number_slider_3, vertical=Toggle(True))  # -> report, hb_objs; plug-in component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

# ----
# Join if Exterior building (surroundings)
addshade = HBAddShade(hb_obj=roomsolid.rooms)  # -> hb_obj; plug-in component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
addsubface = HBAddSubface(hb_obj=flatten(addshade), sub_faces=flatten(aperture.apertures))  # -> hb_obj; plug-in component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
bordershades = HBExtrudedBorderShades(hb_objs=flatten(addsubface), depth=Slider(300, range=0..1000))  # -> report, hb_objs; plug-in component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

# ----
# Pick if you want to analyze a surface
number_slider_4 = Slider(200, range=0..1000)
analyisis_surface = Brep(<brep referenced from the Rhino model>)
genpts = LBGeneratePointGrid(geometry=analyisis_surface, grid_size=number_slider_4)  # -> points, vectors, face_areas, mesh; plug-in component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
sensorgrid = HBSensorGrid(positions=genpts.points, directions=genpts.vectors, mesh=genpts.mesh)  # -> grid; plug-in component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

model = HBModel(rooms=flatten(bordershades.hb_objs))  # -> report, model; plug-in component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

# ----
# Visulize the model
vizwiref = HBVisualizeWireframe(hb_objs=flatten(model.model))  # -> geo; plug-in component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

gridrooms = HBSensorGridFromRooms(rooms=model.model, grid_size=Slider(500, range=0..1000), dist_floor=Slider(800, range=0..800))  # -> grid, points, mesh; plug-in component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
assigngridsviews = HBAssignGridsAndViews(model=model.model, grids=flatten(gridrooms.grid))  # -> model; plug-in component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

north_direction = Panel("0")
annualdaylight = HBAnnualDaylight(model=assigngridsviews, wea=wea, north=north_direction, run=Toggle(True))  # -> report, results, DA, cDA, UDI, UDI_low, UDI_up; plug-in component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

colrange = LBColorRange(index=Slider(1, range=0..10))  # -> colors; plug-in component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
legendpar = LBLegendParameters(min=Slider(0, range=0..100), max=Slider(100, range=0..100), colors=colrange)  # -> leg_par; plug-in component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
heatmap = LBSpatialHeatmap(values=annualdaylight.DA, mesh=gridrooms.mesh, legend_par=legendpar)  # -> mesh, legend, title, colors, legend_par; plug-in component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

ma = MassAddition(Input=annualdaylight.DA)  # -> Result, PartialResults

total_amount_of_sun_hours = Panel(ma.Result)
pt = Point(Point(10299.04043, 1757.494531, 0))
lng = ListLength(List=gridrooms.points)  # -> flatten(Length)
division = Division(A=ma.Result, B=lng)
number = Panel(lng)
panel_2 = Panel(division)
concat = Concatenate(FragmentA="Number of analyzed points: ", FragmentB=number)
Y = UnitY(Factor="1000")
Y_2 = UnitY(Factor="1000")
concat_2 = Concatenate(FragmentA="Total annual Daylight %: ", FragmentB=total_amount_of_sun_hours)
move = Move(Geometry=pt, Motion=expr("-2*x", Y))  # -> Geometry, Transform
concat_3 = Concatenate(FragmentA="Average % daylight: ", FragmentB=panel_2)
move_2 = Move(Geometry=move.Geometry, Motion=expr("-2*x", Y_2))  # -> Geometry, Transform

tag = TextTag3D(Location=pt, Text=concat, Size="1000", Justification=7)
geo = Geometry([heatmap.mesh, heatmap.legend])
tag_2 = TextTag3D(Location=move.Geometry, Text=concat_2, Size="1000", Justification=7)
tag_3 = TextTag3D(Location=move_2.Geometry, Text=concat_3, Size="1000", Justification=7)
