# Grasshopper definition RandomSeed_Surface.gh (Grasshopper 1.0.7)
# plug-ins: Bifocals, EF - R7 Beta, LunchBox, EleFront

# ----
# Defining block units
number_slider = Slider(213, range=0..1000)
box = DomainBox(Base=PlaneXY(0, 0, 0), X=number_slider, Y=Slider(377, range=0..1000), Z=Slider(454, range=0..1000))
X = UnitX(Factor=number_slider)
move = Move(Geometry=box, Motion=X)  # -> Geometry, Transform
move_2 = Move(Geometry=move.Geometry, Motion=X)  # -> Geometry, Transform
join = BrepJoin(Breps=[box, move.Geometry, move_2.Geometry])  # -> Breps, Closed
join_2 = BrepJoin(Breps=[box, move.Geometry])  # -> Breps, Closed
mesh = Mesh(join_2.Breps)
mesh_2 = Mesh(box)
mesh_3 = Mesh(join.Breps)
mjoin = MeshJoin(Meshes=mesh)
mjoin_2 = MeshJoin(Meshes=mesh_2)
mjoin_3 = MeshJoin(Meshes=mesh_3)
merge = Merge(Data1=mjoin_2, Data2=mjoin, Data3=mjoin_3)

# ----
# Boundaries
X_2 = Panel("15000")
Y = Panel("10000")
rectangle = Rectangle(Plane=PlaneXY(0, 0, 0), XSize=X_2, YSize=Y, Radius=0)  # -> Rectangle, Length

# ----
# Input
random_seed = Slider(5, range=2..20)
number_slider_2 = Slider(60, range=0..100)
crv = Curve(rectangle.Rectangle)

# ----
# Inputs
random_seed_2 = Slider(12, range=2..20)

# ----
# Randomize Pt.
subtraction = Subtraction(A=random_seed, B=2)
random = Random(Range="0 to 1", Number=number_slider_2, Seed=random_seed)
random_2 = Random(Range="0 to 1", Number=number_slider_2, Seed=subtraction)
pt = ConstructPoint(XCoordinate=random_2, YCoordinate=random, ZCoordinate=0)

random_3 = Random(Range="0 to 3", Number=number_slider_2, Seed=subtraction, Integers=True)

# ----
# Evaluate Srf
join_3 = JoinCurves(Curves=crv, Preserve=False)
srf = Surface(join_3)
preview = CustomPreview(Geometry=srf, Material=ColourSwatch(SwatchColor=RGB(91, 163, 227)))
evalsrf = EvaluateSurface(Surface=reparameterize(srf), Point=pt)  # -> Point, Normal, UDirection, VDirection, Frame

# ----
# Divide surface in UV
grid = GridStructure(Surface=srf, UDivisions=Slider(14, range=0..100), VDivisions=Slider(13, range=0..100))  # -> StructureLines, StructureNodes
lng = ListLength(List=grid.StructureNodes)

random_4 = Random(Range="0 to 3", Number=lng, Seed=random_seed_2, Integers=True)
item = ListItem(List=merge, Index=random_3, Wrap=True)
item_2 = ListItem(List=merge, Index=random_4, Wrap=True)

list = ValueList({"Point": 0, "Curve": 1, "Arc": 2, "Circle": 3, "Ellipse": 4, "Line": 5, "Polyline": 6, "Surface": 7, "Brep": 8, "Mesh": 9, "Polysurface": 10, "Block": 11, "Text": 12, "TextDot": 13, "Dimension": 14, "LinearDimension": 15, "AngularDimension": 16, "Hatch": 17, "Leader": 18}, selected="Block")
reftype = ReferenceByType(ObjectType=list, lightweight=False)

# ----
# Place them on srf
orient = Orient(Geometry=item_2, Source=PlaneXY(0, 0, 0), Target=grid.StructureNodes)  # -> Geometry, Transform
random_5 = Random(Range="0 to 360", Number=lng, Seed=random_seed_2, Integers=False)
rotate = Rotate(Geometry=orient.Geometry, Angle=random_5, Plane=grid.StructureNodes)  # -> Geometry, Transform
preview_2 = CustomPreview(Geometry=rotate.Geometry, Material=ColourSwatch(SwatchColor=RGB(230, 62, 202)))

# ----
# Place them on srf
orient_2 = Orient(Geometry=item, Source=PlaneXY(0, 0, 0), Target=evalsrf.Point)  # -> Geometry, Transform
random_6 = Random(Range="0 to 360", Number=number_slider_2, Seed=subtraction, Integers=False)
rotate_2 = Rotate(Geometry=orient_2.Geometry, Angle=random_6, Plane=evalsrf.Point)  # -> Geometry, Transform
preview_3 = CustomPreview(Geometry=rotate_2.Geometry, Material=ColourSwatch(SwatchColor=RGB(88, 204, 101)))

reftype_2 = ReferenceByType(ObjectType=list)
