# Grasshopper definition ReadExcel.gh (Grasshopper 1.0.7)
# plug-ins: LunchBox, Bifocals

excel_worksheet_name = Panel("Sheet1")
# CLEAN DATA
# Fix data that is:
# -incorrect
# -innacurate
# -incomplete
# -irrelevant
# Run me!
toggle = BooleanToggle(True)
path = FilePath("C:\Users\Javier\Desktop\Book1.xlsx")
# TIDY DATA
# Organize data:
# - One variable per column
# - One entry per row
# - One purpose per table
# Normally item 0 for each list the column title
excelread = ExcelReader(ReadExcelData=toggle, WorkbookPath=path, WorksheetName=excel_worksheet_name)  # -> Exceptions, ExcelData
panel = Panel(excelread.ExcelData)
split_index = Panel("1")
split = SplitList(List=panel, Index=split_index)  # -> simplify(ListA), simplify(ListB)
path_2 = ConstructPath(Indices="2")
path_3 = ConstructPath(Indices="3")
path_4 = ConstructPath(Indices="0")
path_5 = ConstructPath(Indices="1")
branch = TreeBranch(Tree=split.ListB, Path=path_2, MaintainPaths=True)  # -> flatten(Branch)
branch_2 = TreeBranch(Tree=split.ListB, Path=path_3, MaintainPaths=True)  # -> flatten(Branch)
branch_3 = TreeBranch(Tree=split.ListB, Path=path_4, MaintainPaths=True)  # -> flatten(Branch)
branch_4 = TreeBranch(Tree=split.ListB, Path=path_5, MaintainPaths=True)  # -> flatten(Branch)
panel_2 = Panel(split.ListA)
num = Number(branch_2)
cset = CreateSet(List=branch_3)  # -> Set, Map
panel_3 = Panel(num)
panel_4 = Panel(cset.Set)
layer = CreateLayers()
sort = SortList()  # -> Keys, ValuesA
multiplication = Multiplication(A=panel_3, B="1000000")
sqrt = SquareRoot(Value=multiplication)
round = Round(Number=sqrt)  # -> Nearest, Floor, Ceiling
panel_5 = Panel(round.Nearest)
sort_2 = SortList(Keys=panel_5, ValuesA=branch_3, ValuesB=branch_4, ValuesC=branch)  # -> reverse(Keys), reverse(ValuesA), reverse(ValuesB), reverse(ValuesC)
lng = ListLength(List=panel_5)
item = ListItem(List=sort_2.Keys, Index="0", Wrap=True)
series = Series(Start=0, Step=item, Count=lng)
merge = Merge(Data1=graft(sort_2.ValuesB), Data2=graft(sort_2.ValuesC), Data3=graft(sort_2.Keys))  # -> simplify(Result)
pt = ConstructPoint(XCoordinate=series, YCoordinate="0", ZCoordinate=0)
panel_6 = Panel(merge)
xy = XYPlane(Origin=pt)
box = DomainBox(Base=xy, X=panel_5, Y=panel_5, Z=Slider(3500, range=0..10000))
pt_2 = Point(xy)
number_slider = Slider(1000, range=0..1000)
item_2 = ListItem(List=panel_6, Index=0, Wrap=True)  # -> flatten(Item)
item_3 = ListItem(List=panel_6, Index="2", Wrap=True)  # -> flatten(Item)
item_4 = ListItem(List=panel_6, Index="1", Wrap=True)  # -> flatten(Item)
neg = Negative(Value=number_slider)
panel_7 = Panel(item_2)
panel_8 = Panel(item_4)
panel_9 = Panel(item_3)
Y = UnitY(Factor=neg)
neg_2 = Negative(Value=number_slider)
move = Move(Geometry=pt_2, Motion=Y)  # -> Geometry, Transform
Y_2 = UnitY(Factor=neg_2)
neg_3 = Negative(Value=number_slider)
move_2 = Move(Geometry=move.Geometry, Motion=Y_2)  # -> Geometry, Transform
Y_3 = UnitY(Factor=neg_3)
move_3 = Move(Geometry=move_2.Geometry, Motion=Y_3)  # -> Geometry, Transform
tag = TextTag3D(Location=move.Geometry, Text=panel_7, Size=number_slider, Justification=7)
tag_2 = TextTag3D(Location=move_2.Geometry, Text=panel_8, Size=number_slider, Justification=7)
tag_3 = TextTag3D(Location=move_3.Geometry, Text=panel_9, Size=number_slider, Justification=7)
