# Grasshopper definition RevittoRhino.gh (Grasshopper 1.0.7)
# plug-ins: EleFront, Rhino.Inside for Autodesk Revit, Bifocals

panel = Panel("Rooms")  # disabled
swatch = ColourSwatch(SwatchColor=RGB(175, 210, 113))  # disabled
# Rooms into Rhino
categories = QueryCategories(Type=1, Name=panel, IsSubcategory=False)  # disabled
panel_2 = Panel("Generic Models")
layer = DefineLayer(Name=panel, Color=swatch)  # disabled
catfltr = CategoryFilter(Categories=categories, Inverted=False)  # disabled
elements = QueryElements(Filter=catfltr, Limit=100)  # -> Elements, Count; disabled
# Floors
# Walls
# Ceilings
# Structural Columns
# Curtain Wall Mullions
# Curtain Panels
# Roof
panel_3 = Panel("""Floors
Ramps
Stairs""")
geometry = ElementGeometry(Elements=elements.Elements)  # -> flatten(Geometry); disabled
bbox = BoundingBox(Content=geometry, Plane=PlaneXY(0, 0, 0))  # -> Box, Box_2; disabled

# ----
# Input here!
workset_name = Panel("floors")
category_name = Panel("Stairs")

volume = Volume(Geometry=bbox.Box)  # -> Volume, Centroid; disabled
debox = DeconstructBox(Box=bbox.Box)  # -> Plane, X, Y, Z; disabled
panel_4 = Panel("""Id
Name
Number
Area""")  # disabled
dedomain = DeconstructDomain(Domain=debox.Z)  # -> Start, End; disabled
swatch_2 = ColourSwatch(SwatchColor=RGB(55, 183, 84))
subtraction = Subtraction(A=dedomain.Start, B=dedomain.End)  # disabled
swatch_3 = ColourSwatch(SwatchColor=RGB(234, 216, 84))
swatch_4 = ColourSwatch(SwatchColor=RGB(103, 185, 154))
swatch_5 = ColourSwatch(SwatchColor=RGB(239, 95, 84))
swatch_6 = ColourSwatch(SwatchColor=RGB(154, 58, 84))
swatch_7 = ColourSwatch(SwatchColor=RGB(78, 43, 154))
cset = CreateSet(List=panel_4)  # -> Set, Map; disabled
param = ElementParameter(Element=graft(elements.Elements), Parameter=panel_4)  # -> Element, Parameter, simplify(Value); disabled
panel_5 = Panel("2")  # disabled
sec = BrepPlane(Brep=geometry, Plane=volume.Centroid)  # -> Curves, Points; disabled
panel_6 = Panel("Area")  # disabled
division = Division(A=subtraction, B=panel_5)  # disabled
concat = Concatenate(FragmentA=workset_name, FragmentB="_", FragmentC=category_name)
panel_7 = Panel("-1")  # disabled
mindex = MemberIndex(Set=cset.Set, Member=panel_6)  # -> Index, Count; disabled
Z = UnitZ(Factor=division)  # disabled
item = ListItem(List=param.Value, Index=panel_7, Wrap=True)  # disabled
area = Area(Geometry=sec.Curves)  # -> Area, Centroid; disabled
categories_2 = QueryCategories(Type=1, Name=category_name, IsSubcategory=False)
layer_2 = DefineLayer(Name=concat, Color=ColourSwatch(SwatchColor=RGB(189, 123, 154)))
lng = ListLength(List=panel_4)  # disabled
item_2 = ListItem(List=param.Value, Index=0, Wrap=True)  # -> flatten(Item); disabled
sort = SortList(Keys=area.Area, ValuesA=sec.Curves)  # -> Keys, ValuesA; disabled
panel_8 = Panel("1000000")  # disabled
catfltr_2 = CategoryFilter(Categories=categories_2, Inverted=False)
panel_9 = Panel("-1")  # disabled
worksets = QueryWorksets(Kind=4, Name=workset_name)
item_3 = ListItem(List=sort.ValuesA, Index=panel_9, Wrap=True)  # -> flatten(Item); disabled
division_2 = Division(A=item, B=panel_8)  # disabled
elements_2 = QueryElements(Filter=catfltr_2)  # -> simplify(Elements), Count
repeat = RepeatData(Data=mindex.Index, Length=lng)  # disabled
move = Move(Geometry=item_3, Motion=Z)  # -> Geometry, Transform; disabled
workset = ElementWorkset(Element=elements_2.Elements)  # -> Element, Workset, Status
wsetfltr = WorksetFilter(Workset=worksets, Inverted=False)
brep = Brep(move.Geometry)  # disabled
filtelem = FilterElement(Elements=elements_2.Elements, Filter=wsetfltr)
workset_2 = WorksetIdentity(Workset=workset.Workset)  # -> Kind, Name, Owner, Open, Editable, Visible
replace = ReplaceItems(List=param.Value, Item=division_2, Indices=repeat, Wrap=False)  # disabled
panel_10 = Panel(workset_2.Name)
attributes = DefineObjectAttributes(UserKeys=panel_4, UserValues=replace, Name=graft(item_2), Layer=layer)  # -> flatten(Attributes); disabled
cull = CullPattern(List=elements_2.Elements, CullPattern=filtelem)  # -> flatten(List)
bake = BakeObjects(Geometry=brep, Attributes=attributes, BakeName=panel, Bake=False)  # disabled
panel_11 = Panel(cull)
panel_12 = Panel("""Id
Family Name
Type Name""")
geometry_2 = ElementGeometry(Elements=cull)  # -> simplify(flatten(Geometry))
param_2 = ElementParameter(Element=graft(cull), Parameter=panel_12)  # -> Element, Parameter, simplify(Value)
materials = ElementMaterials(Element=cull)  # -> Materials, Paint
identity = MaterialIdentity(Material=materials.Materials)  # -> simplify(Name), Description, Class, Comments, Manufacturer, Model, Cost, URL, Keynote, Mark
item_4 = ListItem(List=param_2.Value, Index=0, Wrap=True)  # -> flatten(Item)
join = TextJoin(Text=identity.Name, Join=" | ")
ins = InsertItems(List=panel_12, Item="Material", Indices="-1", Wrap=True)
ins_2 = InsertItems(List=param_2.Value, Item=join, Indices="-1", Wrap=True)
attributes_2 = DefineObjectAttributes(UserKeys=ins, UserValues=ins_2, Name=graft(item_4), Layer=layer_2)  # -> simplify(Attributes)

bake_2 = BakeObjects(Geometry=geometry_2, Attributes=attributes_2, BakeName=concat, Bake=False)

panel_13 = Panel(ins_2)

panel_14 = Panel("""Walls
Floors
Ceilings
Roofs
Doors
Windows""")
categories_3 = QueryCategories(Type=1, Name=panel_14, IsSubcategory=False)
catfltr_3 = CategoryFilter(Categories=categories_3, Inverted=False)
elements_3 = QueryElements(Filter=catfltr_3, Limit=100)  # -> simplify(Elements), Count
materials_2 = ElementMaterials(Element=elements_3.Elements)  # -> Materials, Paint
panel_15 = Panel("""Id
Family Name
Type Name""")
geometry_3 = ElementGeometry(Elements=elements_3.Elements)  # -> simplify(Geometry)
identity_2 = MaterialIdentity(Material=materials_2.Materials)  # -> simplify(Name), Description, Class, Comments, Manufacturer, Model, Cost, URL, Keynote, Mark
param_3 = ElementParameter(Element=graft(elements_3.Elements), Parameter=panel_15)  # -> Element, Parameter, simplify(Value)
panel_16 = Panel(geometry_3)
join_2 = TextJoin(Text=identity_2.Name, Join=" | ")
item_5 = ListItem(List=param_3.Value, Index=0, Wrap=True)  # -> flatten(Item)
ins_3 = InsertItems(List=panel_15, Item="Material", Indices="-1", Wrap=True)
ins_4 = InsertItems(List=param_3.Value, Item=join_2, Indices="-1", Wrap=True)

lng_2 = ListLength(List=panel_14)
random = Random(Range="0 to 255", Number=lng_2, Seed="2")
random_2 = Random(Range="0 to 255", Number=lng_2, Seed="3")
random_3 = Random(Range="0 to 255", Number=lng_2, Seed="1")
rgb = ColourRGB(Alpha=255, Red=random_3, Green=random, Blue=random_2)

layer_3 = DefineLayer(Name=panel_14, Color=rgb)
attributes_3 = DefineObjectAttributes(UserKeys=ins_3, UserValues=ins_4, Name=item_5, Layer=layer_3)  # -> simplify(Attributes)
bake_3 = BakeObjects(Geometry=geometry_3, Attributes=attributes_3, BakeName=panel_14, Bake=False)
