# Grasshopper definition Rhino.Inside.gh (Grasshopper 1.0.7)
# plug-ins: EleFront, Rhino.Inside for Autodesk Revit, Bifocals

# ----
# Create Revit Floors
# 1. Rigth click on type and pick a Floor Type
# 2. Enable Floor
rhino_geometry = ValueList({"Point": 0, "Curve": 1, "Arc": 2, "Circle": 3, "Ellipse": 4, "Line": 5, "Polyline": 6, "Surface": 7, "Brep": 8, "Mesh": 9, "Polysurface": 10, "Block": 11, "Text": 12, "TextDot": 13, "Dimension": 14, "LinearDimension": 15, "AngularDimension": 16, "Hatch": 17, "Leader": 18}, selected="Brep")
rhino_geometry_2 = ValueList({"Point": 0, "Curve": 1, "Arc": 2, "Circle": 3, "Ellipse": 4, "Line": 5, "Polyline": 6, "Surface": 7, "Brep": 8, "Mesh": 9, "Polysurface": 10, "Block": 11, "Text": 12, "TextDot": 13, "Dimension": 14, "LinearDimension": 15, "AngularDimension": 16, "Hatch": 17, "Leader": 18}, selected="Block")
rhino_geometry_3 = ValueList({"Point": 0, "Curve": 1, "Arc": 2, "Circle": 3, "Ellipse": 4, "Line": 5, "Polyline": 6, "Surface": 7, "Brep": 8, "Mesh": 9, "Polysurface": 10, "Block": 11, "Text": 12, "TextDot": 13, "Dimension": 14, "LinearDimension": 15, "AngularDimension": 16, "Hatch": 17, "Leader": 18}, selected="Brep")
reftype = ReferenceByType(ObjectType=rhino_geometry_2)  # -> flatten(Block)
reftype_2 = ReferenceByType(ObjectType=rhino_geometry)  # -> flatten(Brep)
deblock = DeconstructBlock(Block=reftype)  # -> Name, Plane, flatten(Geometry)
filtertype = FilterByType(Geometry=deblock.Geometry, ObjectType=rhino_geometry_3)  # -> flatten(Geometry)
rhino_layers = Panel("""Slabs
Floor Slabs""")
merge = Merge(Data1=reftype_2, Data2=filtertype)  # -> flatten(Result)
clean = CleanTree(RemoveNulls=True, RemoveInvalid=True, RemoveEmpty=False, Tree=merge)
filterlay = FilterByLayer(Geometry=clean, Layer=rhino_layers)  # -> flatten(Geometry)
brep = Brep(filterlay)
debrep = DeconstructBrep(Brep=brep)  # -> Faces, Edges, Vertices
curvepoint = PointOnCurve(debrep.Edges, parameter=0.5)
pdecon = Deconstruct(Point=curvepoint)  # -> XComponent, YComponent, ZComponent
sort = SortList(Keys=pdecon.ZComponent, ValuesA=debrep.Edges)  # -> reverse(simplify(Keys)), reverse(simplify(ValuesA))
cset = CreateSet(List=sort.Keys)  # -> Set, Map
item = ListItem(List=cset.Set, Index=0, Wrap=True)
mindex = MemberIndex(Set=sort.Keys, Member=item)  # -> simplify(Index), Count
item_2 = ListItem(List=sort.ValuesA, Index=mindex.Index, Wrap=True)
crv = Curve(item_2)
join = JoinCurves(Curves=crv, Preserve=False)  # -> simplify(Curves)
type = Type(<hostobjecttype referenced from the Revit model>, SelectedBuiltInCategory="autodesk.revit.category.local:floors")
floor = AddFloor(Boundary=join, Type=type, Structural=Toggle(False), TrackingMode=2)  # disabled

# ----
# 1. Rhino Breps + Blocks
# Materials, Categories and Parameter
# Enable Merge!
rhino_geometry_4 = ValueList({"Point": 0, "Curve": 1, "Arc": 2, "Circle": 3, "Ellipse": 4, "Line": 5, "Polyline": 6, "Surface": 7, "Brep": 8, "Mesh": 9, "Polysurface": 10, "Block": 11, "Text": 12, "TextDot": 13, "Dimension": 14, "LinearDimension": 15, "AngularDimension": 16, "Hatch": 17, "Leader": 18}, selected="Brep")
rhino_geometry_5 = ValueList({"Point": 0, "Curve": 1, "Arc": 2, "Circle": 3, "Ellipse": 4, "Line": 5, "Polyline": 6, "Surface": 7, "Brep": 8, "Mesh": 9, "Polysurface": 10, "Block": 11, "Text": 12, "TextDot": 13, "Dimension": 14, "LinearDimension": 15, "AngularDimension": 16, "Hatch": 17, "Leader": 18}, selected="Block")
rhino_geometry_6 = ValueList({"Point": 0, "Curve": 1, "Arc": 2, "Circle": 3, "Ellipse": 4, "Line": 5, "Polyline": 6, "Surface": 7, "Brep": 8, "Mesh": 9, "Polysurface": 10, "Block": 11, "Text": 12, "TextDot": 13, "Dimension": 14, "LinearDimension": 15, "AngularDimension": 16, "Hatch": 17, "Leader": 18}, selected="Brep")
reftype_3 = ReferenceByType(ObjectType=rhino_geometry_5)  # -> flatten(Block)
reftype_4 = ReferenceByType(ObjectType=rhino_geometry_4)  # -> flatten(Brep)
rhino_layers_2 = Panel("""Surroundings
Main Diagrid
Side Truss
Ramps
Foundations
Slabs
Floor Slabs
Interior Partitions""")
revit_materials = Panel("""Material01
Material02
Material03
Material04
Material05
Material06
Material07
Material08""")
revit_categories = Panel("""Generic Models
Structural Framing
Structural Framing
Ramps
Structural Foundations
Floors
Floors
Walls""")
deblock_2 = DeconstructBlock(Block=reftype_3)  # -> Name, Plane, flatten(Geometry)
filtertype_2 = FilterByType(Geometry=deblock_2.Geometry, ObjectType=rhino_geometry_6)  # -> flatten(Geometry)
merge_2 = Merge(Data1=reftype_4, Data2=filtertype_2)  # -> flatten(Result); disabled
keysearch = KeyValueSearch(Keys=rhino_layers_2, Values=revit_categories, Search=rhino_layers_2)
keysearch_2 = KeyValueSearch(Keys=rhino_layers_2, Values=revit_materials, Search=rhino_layers_2)
clean_2 = CleanTree(RemoveNulls=True, RemoveInvalid=True, RemoveEmpty=False, Tree=merge_2)
filterlay_2 = FilterByLayer(Geometry=clean_2, Layer=rhino_layers_2)  # -> simplify(Geometry)
categories = QueryCategories(Type=1, Parent=null, Name=keysearch, IsSubcategory=False)  # -> simplify(Categories)
materials = QueryMaterials(Name=keysearch_2)  # -> simplify(Materials)
lng = ListLength(List=filterlay_2)
material = AddMaterial(Name=keysearch_2, TrackingMode=2)  # -> graft(Material)
repeat = RepeatData(Data=materials, Length=lng)  # -> simplify(graft(Data))
repeat_2 = RepeatData(Data=categories, Length=lng)  # -> simplify(graft(Data))
brep_2 = Brep(graft(filterlay_2))
geodshape = AddGeometryDirectShape(Category=repeat_2, Geometry=brep_2, Material=repeat, TrackingMode=2)
repeat_3 = RepeatData(Data=graft(rhino_layers_2), Length=lng)  # -> simplify(graft(Data))
parametername = Panel("RhinoLayerName")
define_param = DefineParameter(Name=parametername, Type="autodesk.spec:spec.string-2.0.0", Group="autodesk.parameter.group:data-1.0.0")
add_param = AddParameter(Definition=define_param, Scope=Toggle(True), TrackingMode=2)
param = ElementParameter(Element=geodshape, Parameter=define_param, Value=repeat_3)  # -> Element, Value

# ----
# 5. Rhino Blocks - DirectShape
rhino_geometry_7 = ValueList({"Point": 0, "Curve": 1, "Arc": 2, "Circle": 3, "Ellipse": 4, "Line": 5, "Polyline": 6, "Surface": 7, "Brep": 8, "Mesh": 9, "Polysurface": 10, "Block": 11, "Text": 12, "TextDot": 13, "Dimension": 14, "LinearDimension": 15, "AngularDimension": 16, "Hatch": 17, "Leader": 18}, selected="Block")
rhino_layers_3 = Panel("""Layer 01
Layer 02
Layer 03""")
revit_materials_2 = Panel("""Material01
Material02
Material03""")
revit_categories_2 = Panel("""Walls
Floors
Ceilings""")
reftype_5 = ReferenceByType(ObjectType=rhino_geometry_7)  # disabled
deblock_3 = DeconstructBlock(Block=reftype_5)  # -> Name, Plane, Geometry
filterlay_3 = FilterByLayer(Geometry=deblock_3.Geometry, Layer=rhino_layers_3)
list = ValueList({"Point": 0, "Curve": 1, "Arc": 2, "Circle": 3, "Ellipse": 4, "Line": 5, "Polyline": 6, "Surface": 7, "Brep": 8, "Mesh": 9, "Polysurface": 10, "Block": 11, "Text": 12, "TextDot": 13, "Dimension": 14, "LinearDimension": 15, "AngularDimension": 16, "Hatch": 17, "Leader": 18}, selected="Brep")
keysearch_3 = KeyValueSearch(Keys=rhino_layers_3, Values=revit_categories_2, Search=rhino_layers_3)
keysearch_4 = KeyValueSearch(Keys=rhino_layers_3, Values=revit_materials_2, Search=rhino_layers_3)
filtertype_3 = FilterByType(Geometry=filterlay_3, ObjectType=list)
clean_3 = CleanTree(RemoveNulls=True, RemoveInvalid=True, RemoveEmpty=False, Tree=filtertype_3)
lng_2 = ListLength(List=clean_3)
categories_2 = QueryCategories(Type=1, Parent=null, Name=keysearch_3, IsSubcategory=False)
material_2 = AddMaterial(Name=keysearch_4, TrackingMode=2)  # -> graft(Material)
repeat_4 = RepeatData(Data=categories_2, Length=lng_2)  # -> graft(Data)
repeat_5 = RepeatData(Data=material_2, Length=lng_2)  # -> graft(Data)
brep_3 = Brep(graft(clean_3))
geodshape_2 = AddGeometryDirectShape(Category=repeat_4, Geometry=brep_3, Material=repeat_5, TrackingMode=2)

# ----
# 3.Rhino Breps into Revit - DriectShape
rhino_geometry_8 = ValueList({"Point": 0, "Curve": 1, "Arc": 2, "Circle": 3, "Ellipse": 4, "Line": 5, "Polyline": 6, "Surface": 7, "Brep": 8, "Mesh": 9, "Polysurface": 10, "Block": 11, "Text": 12, "TextDot": 13, "Dimension": 14, "LinearDimension": 15, "AngularDimension": 16, "Hatch": 17, "Leader": 18}, selected="Brep")
rhino_geometry_9 = ValueList({"Default"}, selected="Default")
reftype_6 = ReferenceByType(ObjectType=rhino_geometry_8)  # disabled
revit_materials_3 = Panel("MaterialName01")
revit_category_name = Panel("Walls")
filterlay_4 = FilterByLayer(Geometry=reftype_6, Layer=rhino_geometry_9)  # -> graft(Geometry)
material_3 = AddMaterial(Name=revit_materials_3, TrackingMode=2)
categories_3 = QueryCategories(Type=1, Parent=null, Name=revit_category_name, IsSubcategory=False)
geodshape_3 = AddGeometryDirectShape(Category=categories_3, Geometry=filterlay_4, Material=material_3, TrackingMode=2)

cset_2 = CreateSet(List=item)  # -> flatten(Set), Map
sort_2 = SortList(Keys=cset_2.Set)  # -> Keys, ValuesA

# ----
# 3.Rhino Breps into Revit - DriectShape
rhino_geometry_10 = ValueList({"Point": 0, "Curve": 1, "Arc": 2, "Circle": 3, "Ellipse": 4, "Line": 5, "Polyline": 6, "Surface": 7, "Brep": 8, "Mesh": 9, "Polysurface": 10, "Block": 11, "Text": 12, "TextDot": 13, "Dimension": 14, "LinearDimension": 15, "AngularDimension": 16, "Hatch": 17, "Leader": 18}, selected="Brep")
rhino_geometry_11 = ValueList({"Default"}, selected="Default")
reflay = ReferenceByLayer(LayerName=rhino_geometry_11)  # disabled
revit_materials_4 = Panel("MaterialName01")
filtertype_4 = FilterByType(Geometry=reflay, ObjectType=rhino_geometry_10)  # -> graft(Geometry)
revit_category_name_2 = Panel("Walls")
material_4 = AddMaterial(Name=revit_materials_4, TrackingMode=2)
categories_4 = QueryCategories(Type=1, Parent=null, Name=revit_category_name_2, IsSubcategory=False)
geodshape_4 = AddGeometryDirectShape(Category=categories_4, Geometry=filtertype_4, Material=material_4, TrackingMode=2)

lng_3 = ListLength(List=sort_2.Keys)
xy = XYPlane(Origin=Point(0, 0, 0))

# ----
# 1. Rhino Blocks to Revit Family
rhino_geometry_12 = ValueList({"Point": 0, "Curve": 1, "Arc": 2, "Circle": 3, "Ellipse": 4, "Line": 5, "Polyline": 6, "Surface": 7, "Brep": 8, "Mesh": 9, "Polysurface": 10, "Block": 11, "Text": 12, "TextDot": 13, "Dimension": 14, "LinearDimension": 15, "AngularDimension": 16, "Hatch": 17, "Leader": 18}, selected="Block")
rhino_geometry_type = Panel("Block")
rhino_layer_name = Panel("Default")
reftype_7 = ReferenceByType(ObjectType=rhino_geometry_12)  # disabled
filterlay_5 = FilterByLayer(Geometry=reftype_7, Layer=rhino_layer_name)
revit_template_path_location = Panel("C:\ProgramData\Autodesk\RVT 2021\Family Templates\English\Metric Generic Model.rft")
family_name = Panel("family Name")
revit_category_name_3 = Panel("Generic Models")
deblock_4 = DeconstructBlock(Block=filterlay_5)  # -> Name, Plane, Geometry
categories_5 = QueryCategories(Type=1, Parent=null, Name=revit_category_name_3, IsSubcategory=False)
new = NewComponentFamily(
    Template=revit_template_path_location,
    Overwrite=Toggle(True),
    Name=family_name,
    Category=categories_5,
    Geometry=deblock_4.Geometry)
types = FamilyTypes(Family=new)
comploca = AddComponentLocation(Location=xy, Type=types, TrackingMode=2)

series = Series(Start=0, Step=1, Count=lng_3)
concat = Concatenate(FragmentA="Level ", FragmentB=series)

# ----
# 0. Create Levels in Revit
# -Input elevation and level names
elevation = Panel(sort_2.Keys)
level_name = Panel(concat)
num = Number(elevation)
split_character = Panel(" ")
level = AddLevel(Elevation=num, Name=level_name, TrackingMode=2)
split = TextSplit(Text=level_name, Separators=split_character)  # -> simplify(Result)
item_3 = ListItem(List=split, Index=-1, Wrap=True)  # -> simplify(flatten(Item))
parameter = Panel("ID_LevelLocation")
param_2 = ElementParameter(Element=level, Parameter=parameter, Value=item_3)  # -> Element, Value

toggle = BooleanToggle(True)

# ----
# Create Revit Walls
# 1. Rigth click on type and pick a Floor Type
# 2. Enable Floor
rhino_geometry_13 = ValueList({"Point": 0, "Curve": 1, "Arc": 2, "Circle": 3, "Ellipse": 4, "Line": 5, "Polyline": 6, "Surface": 7, "Brep": 8, "Mesh": 9, "Polysurface": 10, "Block": 11, "Text": 12, "TextDot": 13, "Dimension": 14, "LinearDimension": 15, "AngularDimension": 16, "Hatch": 17, "Leader": 18}, selected="Brep")
rhino_geometry_14 = ValueList({"Point": 0, "Curve": 1, "Arc": 2, "Circle": 3, "Ellipse": 4, "Line": 5, "Polyline": 6, "Surface": 7, "Brep": 8, "Mesh": 9, "Polysurface": 10, "Block": 11, "Text": 12, "TextDot": 13, "Dimension": 14, "LinearDimension": 15, "AngularDimension": 16, "Hatch": 17, "Leader": 18}, selected="Block")
rhino_geometry_15 = ValueList({"Point": 0, "Curve": 1, "Arc": 2, "Circle": 3, "Ellipse": 4, "Line": 5, "Polyline": 6, "Surface": 7, "Brep": 8, "Mesh": 9, "Polysurface": 10, "Block": 11, "Text": 12, "TextDot": 13, "Dimension": 14, "LinearDimension": 15, "AngularDimension": 16, "Hatch": 17, "Leader": 18}, selected="Brep")
reftype_8 = ReferenceByType(ObjectType=rhino_geometry_14)  # -> flatten(Block)
reftype_9 = ReferenceByType(ObjectType=rhino_geometry_13)  # -> flatten(Brep)
deblock_5 = DeconstructBlock(Block=reftype_8)  # -> Name, Plane, flatten(Geometry)
filtertype_5 = FilterByType(Geometry=deblock_5.Geometry, ObjectType=rhino_geometry_15)  # -> flatten(Geometry)
rhino_layers_4 = Panel("Interior Partitions")
merge_3 = Merge(Data1=reftype_9, Data2=filtertype_5)  # -> flatten(Result)
clean_4 = CleanTree(RemoveNulls=True, RemoveInvalid=True, RemoveEmpty=False, Tree=merge_3)
filterlay_6 = FilterByLayer(Geometry=clean_4, Layer=rhino_layers_4)  # -> flatten(Geometry)
brep_4 = Brep(filterlay_6)
debrep_2 = DeconstructBrep(Brep=brep_4)  # -> Faces, Edges, Vertices
curvepoint_2 = PointOnCurve(debrep_2.Edges, parameter=0.5)
pdecon_2 = Deconstruct(Point=curvepoint_2)  # -> XComponent, YComponent, ZComponent
sort_3 = SortList(Keys=pdecon_2.ZComponent, ValuesA=debrep_2.Edges)  # -> simplify(Keys), simplify(ValuesA)
cset_3 = CreateSet(List=sort_3.Keys)  # -> Set, Map
item_4 = ListItem(List=cset_3.Set, Index=0, Wrap=True)
mindex_2 = MemberIndex(Set=sort_3.Keys, Member=item_4)  # -> simplify(Index), Count
item_5 = ListItem(List=sort_3.ValuesA, Index=mindex_2.Index, Wrap=True)
curvepoint_3 = PointOnCurve(item_5, parameter=0.5)
crossref = CrossReference(ListA=curvepoint_3, ListB=curvepoint_3, CrossMode=1)  # -> ListA, ListB
ln = Line(StartPoint=crossref.ListA, EndPoint=crossref.ListB)
clean_5 = CleanTree(RemoveNulls=toggle, RemoveInvalid=toggle, RemoveEmpty=toggle, Tree=ln)
len = Length(Curve=clean_5)
sort_4 = SortList(Keys=len, ValuesA=clean_5)  # -> reverse(Keys), reverse(ValuesA)
item_6 = ListItem(List=sort_4.ValuesA, Index=0, Wrap=True)
crv_2 = Curve(item_6)
join_2 = JoinCurves(Curves=crv_2, Preserve=False)  # -> simplify(Curves)
wll = WallLocationLine({"Wall Centerline": 0, "Core Centerline": 1, "Finish (Exterior Face)": 2, "Finish (Interior Face)": 3, "Core (Exterior Face)": 4, "Core (Interior Face)": 5}, selected="Wall Centerline")
type_2 = Type(<hostobjecttype referenced from the Revit model>, SelectedBuiltInCategory="autodesk.revit.category.local:walls")
wallcrv = AddWallCurve(Curve=join_2, Type=type_2, Height=Slider(100, range=0..100), LocationLine=wll, AllowJoins=Toggle(True), TrackingMode=2)

# ----
# 0. Check Rhino model integrity
# - Set View on WireFrame
# - BadSrf will show on pink in Rhino
list_2 = ValueList({"Point": 0, "Curve": 1, "Arc": 2, "Circle": 3, "Ellipse": 4, "Line": 5, "Polyline": 6, "Surface": 7, "Brep": 8, "Mesh": 9, "Polysurface": 10, "Block": 11, "Text": 12, "TextDot": 13, "Dimension": 14, "LinearDimension": 15, "AngularDimension": 16, "Hatch": 17, "Leader": 18}, selected="Brep")
reftype_10 = ReferenceByType(ObjectType=list_2)  # disabled
brpdshape = AddBrepDirectShape(Brep=reftype_10, TrackingMode=2)
geometry = ElementGeometry(Elements=brpdshape)
tmatch = MatchText(Text=geometry, Pattern="Mesh", Case=True)
cull = CullPattern(List=geometry, CullPattern=tmatch)
mesh = Mesh(cull)
preview = CustomPreview(Geometry=mesh, Material=ColourSwatch(SwatchColor=RGB(249, 29, 255)))
panel = Panel(mesh)

xy_2 = XYPlane(Origin=Point(0, 0, 0))

# ----
# 2. Rhino Breps into Revit Family - Subcategories and materials
rhino_geometry_16 = ValueList({"Point": 0, "Curve": 1, "Arc": 2, "Circle": 3, "Ellipse": 4, "Line": 5, "Polyline": 6, "Surface": 7, "Brep": 8, "Mesh": 9, "Polysurface": 10, "Block": 11, "Text": 12, "TextDot": 13, "Dimension": 14, "LinearDimension": 15, "AngularDimension": 16, "Hatch": 17, "Leader": 18}, selected="Brep")
type_of_geometry = Panel("Brep")
rhino_layers_5 = Panel("""Layer 01
Layer 02
Layer 03""")
revit_user_created_subcategories = Panel("""Family SubCategory01
Family SubCategory02
Family SubCategory03""")
revit_materials_5 = Panel("""RevitMaterial01
RevitMaterial02
RevitMaterial03""")
revit_category_name_4 = Panel("Generic Models")
revit_template_path_location_2 = Panel("C:\ProgramData\Autodesk\RVT 2021\Family Templates\English\Metric Generic Model.rft")
family_name_2 = Panel("family Name")
reftype_11 = ReferenceByType(ObjectType=rhino_geometry_16)  # disabled
filterlay_7 = FilterByLayer(Geometry=reftype_11, Layer=rhino_layers_5)  # -> simplify(Geometry)
keysearch_5 = KeyValueSearch(Keys=rhino_layers_5, Values=revit_user_created_subcategories, Search=rhino_layers_5)
keysearch_6 = KeyValueSearch(Keys=rhino_layers_5, Values=revit_materials_5, Search=rhino_layers_5)
categories_6 = QueryCategories(Type=1, Parent=null, Name=revit_category_name_4, IsSubcategory=False)
material_5 = AddMaterial(Name=keysearch_6, TrackingMode=2)  # -> graft(Material)
subcat = AddSubCategory(Parent=categories_6, Name=keysearch_5, TrackingMode=2)  # -> graft(SubCategory)
famform = ComponentFamilyForm(Brep=filterlay_7, Subcategory=subcat, Material=material_5)  # -> simplify(flatten(Brep))
new_2 = NewComponentFamily(
    Template=revit_template_path_location_2,
    Overwrite=Toggle(True),
    Name=family_name_2,
    Category=categories_6,
    Geometry=famform)
types_2 = FamilyTypes(Family=new_2)
comploca_2 = AddComponentLocation(Location=xy_2, Type=types_2, TrackingMode=2)

# ----
# 4. Rhino Breps - DirectShape:
# Layers, Categories and Materials
rhino_geometry_17 = ValueList({"Point": 0, "Curve": 1, "Arc": 2, "Circle": 3, "Ellipse": 4, "Line": 5, "Polyline": 6, "Surface": 7, "Brep": 8, "Mesh": 9, "Polysurface": 10, "Block": 11, "Text": 12, "TextDot": 13, "Dimension": 14, "LinearDimension": 15, "AngularDimension": 16, "Hatch": 17, "Leader": 18}, selected="Brep")
revit_categories_3 = Panel("""Walls
Floors
Ceilings""")
rhino_layers_6 = Panel("""Layer 01
Layer 02
Layer 03""")
revit_materials_6 = Panel("""Material01
Material02
Material03""")
reftype_12 = ReferenceByType(ObjectType=rhino_geometry_17)  # disabled
filterlay_8 = FilterByLayer(Geometry=reftype_12, Layer=rhino_layers_6)
keysearch_7 = KeyValueSearch(Keys=rhino_layers_6, Values=revit_materials_6, Search=rhino_layers_6)
clean_6 = CleanTree(RemoveNulls=True, RemoveInvalid=True, RemoveEmpty=False, Tree=filterlay_8)
material_6 = AddMaterial(Name=keysearch_7, TrackingMode=2)  # -> graft(Material)
lng_4 = ListLength(List=clean_6)
repeat_6 = RepeatData(Data=material_6, Length=lng_4)  # -> graft(Data)
brep_5 = Brep(graft(clean_6))
parametername_2 = Panel("RhinoLayerName")
repeat_7 = RepeatData(Data=graft(rhino_layers_6), Length=lng_4)  # -> graft(Data)
define_param_2 = DefineParameter(Name=parametername_2, Type="autodesk.spec:spec.string-2.0.0", Group="autodesk.parameter.group:data-1.0.0")
add_param_2 = AddParameter(Definition=define_param_2, Scope=Toggle(True), TrackingMode=2)

cluster = Cluster(K=rhino_layers_6, V=revit_categories_3, S=rhino_layers_6)

categories_7 = QueryCategories(Type=1, Parent=null, Name=cluster, IsSubcategory=False)
repeat_8 = RepeatData(Data=categories_7, Length=lng_4)  # -> graft(Data)
geodshape_5 = AddGeometryDirectShape(Category=repeat_8, Geometry=brep_5, Material=repeat_6, TrackingMode=2)
param_3 = ElementParameter(Element=geodshape_5, Parameter=add_param_2, Value=repeat_7)  # -> Element, Value

# ==== cluster Cluster
K = ClusterInput()
V = ClusterInput()
S = ClusterInput()
keysearch = KeyValueSearch(Keys=K, Values=V, Search=S)
R = ClusterOutput(keysearch)
