# Grasshopper definition Timer_Rotate.gh (Grasshopper 1.0.7)

trigger = Trigger(Interval=20, TimerInterval=20, Target=num)
X = UnitX(Factor=1)
number_slider = Slider(20, range=0..100)
num = Number(Slider(0.4, range=0..10))
line = LineSDL(Start=Point(0, 0, 0), Direction=X, Length=Slider(300, range=0..1000))
rec = DataRecorder(num, DataLimit=-10, RecordData=True)
ma = MassAddition(Input=rec)  # -> Result, PartialResults
divide = DivideCurve(Curve=line, Count=number_slider, Kinks=False)  # -> Points, Tangents, Parameters
series = Series(Start=0, Step=ma.Result, Count=number_slider)
cull_i = CullIndex(List=divide.Points, Indices="0", Wrap=True)
pt = Point(Point(0, 0, 0))
rot3d = Rotate3D(Geometry=cull_i, Angle=degrees(series), Center=pt, Axis=Vector(0, 0, 1))  # -> Geometry, Transform
pline = PolyLine(Vertices=rot3d.Geometry, Closed=False)
cloud = CloudDisplay(Points=rot3d.Geometry, Colours=ColourSwatch(SwatchColor=RGB(0, 0, 0)), Size=Slider(10, range=0..100), SpriteType=1)
