# Grasshopper definition WIP_MassGenerator.gh (Grasshopper 1.0.7)
# plug-ins: Bifocals

# ----
# Output
seed_selector = Slider(61, range=0..500)
text_size = Panel("1000")
pt = Point(Point(666.0244538, -9574.383552, 0))

# ----
# Location input
offset_from_boundary = Panel("5000")
target = Panel("30 to 70")
crv = Curve(<curve referenced from the Rhino model>)

# ----
# Massing input
footprint_size_range_in_mm = Panel("10000 to 15000")
building_heights_range_in_mm = Panel("5000 to 20000")
target_gfa_in_m2 = Panel("9000")
floor_height_mm = Panel("3500")

genes = GenePool(Decimals=1, Maximum=100, Minimum=0, Value=[72.5, 52.8, 30.6])
genes_2 = GenePool(Decimals=1, Maximum=100, Minimum=0, Value=[25, 32.9, 43.9])

remap = RemapNumbers(Value=genes, Source="0 to 100", Target=target)  # -> Mapped, Clipped
remap_2 = RemapNumbers(Value=genes_2, Source="0 to 100", Target=target)  # -> Mapped, Clipped
division = Division(A=remap.Mapped, B="100")
division_2 = Division(A=remap_2.Mapped, B="100")
offset = OffsetCurve(Curve=crv, Distance=expr("-x", offset_from_boundary), Corners=1)
pt_2 = ConstructPoint(XCoordinate=division, YCoordinate=division_2, ZCoordinate=0)
srf = Surface(reparameterize(offset))

genes_3 = GenePool(Decimals=1, Maximum=100, Minimum=0, Value=[3.7, 69.2, 36.6])
genes_4 = GenePool(Decimals=1, Maximum=100, Minimum=0, Value=[41.2, 39.8, 26.9])
genes_5 = GenePool(Decimals=1, Maximum=100, Minimum=0, Value=[77.8, 33, 34.9])

evalsrf = EvaluateSurface(Surface=srf, Point=pt_2)  # -> Point, Normal, UDirection, VDirection, Frame
preview = CustomPreview(Geometry=srf, Material=ColourSwatch(SwatchColor=RGB(207, 109, 109)))
pt_3 = Point(evalsrf.Point)
remap_3 = RemapNumbers(Value=genes_4, Source="0 to 100", Target=building_heights_range_in_mm)  # -> Mapped, Clipped
remap_4 = RemapNumbers(Value=genes_5, Source="0 to 100", Target=footprint_size_range_in_mm)  # -> Mapped, Clipped
remap_5 = RemapNumbers(Value=genes_3, Source="0 to 100", Target=footprint_size_range_in_mm)  # -> Mapped, Clipped
dom = ConstructDomain(DomainStart=expr("-x/2", remap_5.Mapped), DomainEnd=expr("x/2", remap_5.Mapped))
dom_2 = ConstructDomain(DomainStart=expr("-x/2", remap_4.Mapped), DomainEnd=expr("x/2", remap_4.Mapped))
Z = UnitZ(Factor=remap_3.Mapped)
division_3 = Division(A=remap_3.Mapped, B=floor_height_mm)
rectangle = Rectangle(Plane=pt_3, XSize=dom, YSize=dom_2, Radius=0)  # -> Rectangle, Length
round = Round(Number=division_3)  # -> Nearest, Floor, Ceiling
srf_2 = Surface(rectangle.Rectangle)
extr = Extrude(Base=srf_2, Direction=Z)
sunion = SolidUnion(Breps=extr)
preview_2 = CustomPreview(Geometry=extr, Material=ColourSwatch(SwatchColor=RGB(128, 209, 205)))
Z_2 = UnitZ(Factor=1)
contour = Contour(Shape=sunion, Point=Point(0, 0, 0), Direction=Z_2, Distance=floor_height_mm)  # -> simplify(flatten(Contours))
srf_3 = Surface(contour)
clean = CleanTree(RemoveNulls=True, RemoveInvalid=True, RemoveEmpty=False, Tree=srf_3)
area = Area(Geometry=clean)  # -> Area, Centroid
multiplication = Multiplication(A=area.Area, B=round.Nearest)
matrix = ConstructMatrix(Rows="1", Columns="3", Values=remap_4.Mapped)
matrix_2 = ConstructMatrix(Rows="1", Columns="3", Values=remap_5.Mapped)
matrix_3 = ConstructMatrix(Rows="1", Columns="3", Values=remap_3.Mapped)
ma = MassAddition(Input=multiplication)  # -> Result, PartialResults
division_4 = Division(A=ma.Result, B="1000000")
number_slider = Slider(39744, range=0..50000)
subtraction = Subtraction(A=division_4, B=target_gfa_in_m2)
group = Group(Objects=sunion)
expression = Expression(x=subtraction, Expression="if(x>0,-99999999,x)")
random = Random(Range=Domain(0, 1000), Number=1, Seed=number_slider)
gfa_m2 = DataRecorder(division_4, DataLimit=-10, RecordData=True)
geometry = DataRecorder(group, DataLimit=-10, RecordData=True)
x_size = DataRecorder(matrix_2, DataLimit=-10, RecordData=True)
z_size = DataRecorder(matrix_3, DataLimit=-10, RecordData=True)
y_size = DataRecorder(matrix, DataLimit=-10, RecordData=True)
fitting_value = DataRecorder(expression, DataLimit=-10, RecordData=True)

# ----
# Randomize options first!
num = Number(random)

galapagos = Galapagos(fitness=num, gene=[genes_3, genes_5, genes_4, genes, genes_2, number_slider])

# ----
# With chosen option in mind
num_2 = Number(expression)

dematrix = DeconstructMatrix(Matrix=x_size)  # -> Rows, Columns, simplify(Values)
dematrix_2 = DeconstructMatrix(Matrix=z_size)  # -> Rows, Columns, simplify(Values)
dematrix_3 = DeconstructMatrix(Matrix=y_size)  # -> Rows, Columns, simplify(Values)
cull_i = CullIndex(List=fitting_value, Indices="0", Wrap=True)
panel = Panel(num_2)
sort = SortList(Keys=cull_i)  # -> simplify(Keys), ValuesA
rev = ReverseList(List=sort.Keys)  # -> flatten(List)
mindex = MemberIndex(Set=cull_i, Member=rev)  # -> simplify(flatten(Index)), Count
simplify = SimplifyTree(Tree=mindex.Index, Front=False)  # -> simplify(graft(Tree))
item = ListItem(List=dematrix.Values, Index=simplify, Wrap=True)
item_2 = ListItem(List=dematrix_2.Values, Index=simplify, Wrap=True)
item_3 = ListItem(List=dematrix_3.Values, Index=simplify, Wrap=True)
trim = TrimTree(Tree=item_3, Depth=1)
trim_2 = TrimTree(Tree=item_2, Depth=1)
trim_3 = TrimTree(Tree=item, Depth=1)
item_4 = ListItem(List=geometry, Index=simplify, Wrap=True)
item_5 = ListItem(List=gfa_m2, Index=simplify, Wrap=True)  # -> simplify(Item)
round_2 = Round(Number=item_5)  # -> Nearest, Floor, Ceiling
branch = TreeBranch(Tree=item_4, Path=seed_selector, MaintainPaths=True)
branch_2 = TreeBranch(Tree=round_2.Nearest, Path=seed_selector, MaintainPaths=True)
branch_3 = TreeBranch(Tree=trim_3, Path=seed_selector, MaintainPaths=True)
branch_4 = TreeBranch(Tree=trim, Path=seed_selector, MaintainPaths=True)
branch_5 = TreeBranch(Tree=trim_2, Path=seed_selector, MaintainPaths=True)
panel_2 = Panel(branch_2)
preview_3 = CustomPreview(
    Geometry=branch,
    Material={diffuse=RGB(221, 160, 221), emission=RGB(66, 48, 66), shine=0.5, specular=RGB(255, 255, 255), transparency=0})
panel_3 = Panel(branch_4)
panel_4 = Panel(branch_5)
panel_5 = Panel(branch_3)

multiplication_2 = Multiplication(A=text_size, B=-1.5)
Y = UnitY(Factor=multiplication_2)
move = Move(Geometry=pt, Motion=Y)  # -> Geometry, Transform
concat = Concatenate(FragmentA="GFA: ", FragmentB=branch_2, FragmentA_2="m2")
concat_2 = Concatenate(FragmentA="seed nr: ", FragmentB=seed_selector)
tag = TextTag3D(Location=pt, Text=concat_2, Size=text_size, Justification=7)
tag_2 = TextTag3D(Location=move.Geometry, Text=concat, Size=text_size, Justification=7)
