# Grasshopper definition WIP_PrefabModule.gh (Grasshopper 1.0.7)
# plug-ins: Bifocals

# ---- group: Footprint
X = Slider(60, range=0..100, expression="x*500")
Y = Slider(77, range=0..100, expression="x*500")
pt = ConstructPoint(XCoordinate=0, YCoordinate=0, ZCoordinate=0)
pt_2 = Point(pt)
X_2 = UnitX(Factor=X)
Y_2 = UnitY(Factor=Y)
move = Move(Geometry=pt_2, Motion=Y_2)  # -> Geometry, Transform
move_2 = Move(Geometry=move.Geometry, Motion=X_2)  # -> Geometry, Transform
move_3 = Move(Geometry=pt_2, Motion=X_2)  # -> Geometry, Transform
offset = Slider(48, range=0..100, expression="x*500")
pline = PolyLine(Vertices=[pt_2, move.Geometry, move_2.Geometry, move_3.Geometry], Closed=False)
offset_2 = OffsetCurve(Curve=pline, Distance=offset, Corners=1)
end = EndPoints(Curve=offset_2)  # -> Start, End
ln = Line(StartPoint=move_3.Geometry, EndPoint=end.End)
ln_2 = Line(StartPoint=pt_2, EndPoint=end.Start)
join = JoinCurves(Curves=flatten([ln, pline, ln_2, offset_2]), Preserve=False)
boundary = BoundarySurfaces(Edges=join)

# ----
brep = Brep(<brep referenced from the Rhino model>)
number_of_levels = Slider(2, range=0..10)
shift_column_location = Slider(0, range=-500..500, expression="x*100")

column_gird_x = Slider(13, range=0..50, expression="x*500")
column_gird_y = Slider(18, range=0..50, expression="x*500")

glass_thickness = Slider(3, range=0..20, expression="x*50")
column_z = Slider(35, range=0..50, expression="x*100")
beam_z = Slider(10, range=0..25, expression="x*50")
slab_thickness = Slider(6, range=0..20, expression="x*50")
overhang = Slider(25, range=0..50, expression="x*100")

column_x = Slider(14, range=0..50, expression="x*50")
column_y = Slider(16, range=0..50, expression="x*50")

base_geometry = Geometry(boundary)
base_crv = Curve(base_geometry)

area = Area(Geometry=base_geometry)  # -> Area, Centroid
Y_3 = UnitY(Factor=shift_column_location)
move_4 = Move(Geometry=area.Centroid, Motion=Y_3)  # -> Geometry, Transform
Y_4 = UnitY(Factor=1)
X_3 = UnitX(Factor=1)
contour = Contour(Shape=base_geometry, Point=move_4.Geometry, Direction=Y_4, Distance=column_gird_x)
contour_2 = Contour(Shape=base_geometry, Point=move_4.Geometry, Direction=X_3, Distance=column_gird_y)
mcx = MultipleCurves(Curves=flatten([contour, contour_2]))  # -> Points, IndexA, IndexB, ParamA, ParamB
cullpt = CullDuplicates(Points=flatten(mcx.Points), Tolerance=0.1, CullMode=3)  # -> Points, Indices, Valence
pt_3 = Point(cullpt.Points)
vec = VectorXYZ(XComponent=column_x, YComponent=column_y, ZComponent=0)  # -> Vector, Length
rectangle = Rectangle(Plane=pt_3, XSize=column_x, YSize=column_y, Radius=0)  # -> Rectangle, Length
division = Division(A=vec.Vector, B=2)
neg = Negative(Value=division)
move_5 = Move(Geometry=rectangle.Rectangle, Motion=neg)  # -> Geometry, Transform
boundary_2 = BoundarySurfaces(Edges=move_5.Geometry)
Z = UnitZ(Factor=column_z)
Z_2 = UnitZ(Factor=beam_z)
extr = Extrude(Base=boundary_2, Direction=Z)
move_6 = Move(Geometry=contour_2, Motion=Z)  # -> Geometry, Transform
move_7 = Move(Geometry=contour, Motion=Z)  # -> Geometry, Transform
columns = Geometry(extr)
extr_2 = Extrude(Base=move_7.Geometry, Direction=Z_2)
extr_3 = Extrude(Base=move_6.Geometry, Direction=Z_2)
division_2 = Division(A=column_x, B=2)
division_3 = Division(A=column_y, B=2)
X_4 = UnitX(Factor=division_2)
Y_5 = UnitY(Factor=division_3)
neg_2 = Negative(Value=X_4)
neg_3 = Negative(Value=Y_5)
move_8 = Move(Geometry=extr_3, Motion=neg_2)  # -> Geometry, Transform
X_5 = UnitX(Factor=column_x)
Y_6 = UnitY(Factor=column_y)
move_9 = Move(Geometry=extr_2, Motion=neg_3)  # -> Geometry, Transform
glass_mullion_x = Slider(6, range=0..20, expression="x*50")
glass_mullion_y = Slider(7, range=0..20, expression="x*50")
extr_4 = Extrude(Base=move_8.Geometry, Direction=X_5)
extr_5 = Extrude(Base=move_9.Geometry, Direction=Y_6)
ccx = CurveCurve(CurveA=flatten([contour, contour_2]), CurveB=base_crv)  # -> Points, ParamsA, ParamsB
addition = Addition(A=column_z, B=beam_z)
sunion = SolidUnion(Breps=flatten([extr_5, extr_4]))
rectangle_2 = Rectangle(Plane=ccx.Points, XSize=glass_mullion_x, YSize=glass_mullion_y, Radius=0)  # -> Rectangle, Length
Z_3 = UnitZ(Factor=addition)
fmerge = MergeFaces(Brep=flatten(sunion))  # -> Breps, Before, After
vec_2 = VectorXYZ(XComponent=glass_mullion_x, YComponent=glass_mullion_y, ZComponent=0)  # -> Vector, Length
move_10 = Move(Geometry=base_geometry, Motion=Z_3)  # -> Geometry, Transform
division_4 = Division(A=vec_2.Vector, B=2)
beam_system = Geometry(fmerge.Breps)
crv = Curve(move_10.Geometry)
neg_4 = Negative(Value=division_4)
Z_4 = UnitZ(Factor=slab_thickness)
move_11 = Move(Geometry=rectangle_2.Rectangle, Motion=neg_4)  # -> Geometry, Transform
offset_3 = OffsetCurve(Curve=crv, Distance=overhang, Corners=1)
boundary_3 = BoundarySurfaces(Edges=offset_3)
crv_2 = Curve(move_11.Geometry)
division_5 = Division(A=glass_mullion_y, B=2)
neg_5 = Negative(Value=Z_4)
boundary_4 = BoundarySurfaces(Edges=crv_2)
offset_4 = OffsetCurve(Curve=base_crv, Distance=division_5, Corners=1)
extr_6 = Extrude(Base=boundary_3, Direction=Z_4)
extr_7 = Extrude(Base=base_geometry, Direction=neg_5)
slab = Geometry(extr_6)
offset_5 = OffsetCurve(Curve=offset_4, Distance=glass_thickness, Corners=1)
boundary_5 = BoundarySurfaces(Edges=flatten([offset_5, offset_4]))
addition_2 = Addition(A=addition, B=slab_thickness)
multiplication = Multiplication(A=addition_2, B=number_of_levels)
subtraction = Subtraction(A=multiplication, B=slab_thickness)
Z_5 = UnitZ(Factor=subtraction)
extr_8 = Extrude(Base=boundary_4, Direction=Z_5)
Z_6 = UnitZ(Factor=addition)
series = Series(Start=0, Step=addition_2, Count=number_of_levels)
extr_9 = Extrude(Base=boundary_5, Direction=Z_6)
Z_7 = UnitZ(Factor=series)
move_12 = Move(Geometry=graft(beam_system), Motion=Z_7)  # -> Geometry, Transform
move_13 = Move(Geometry=graft(columns), Motion=Z_7)  # -> Geometry, Transform
move_14 = Move(Geometry=graft(slab), Motion=Z_7)  # -> Geometry, Transform
geo = Geometry(extr_9)
slab_gf = Geometry(extr_7)
move_15 = Move(Geometry=graft(geo), Motion=Z_7)  # -> Geometry, Transform
beam_array = Brep(move_12.Geometry)
slab_array = Brep(move_14.Geometry)
column_array = Brep(move_13.Geometry)
glass_array = Brep(move_15.Geometry)
brep_2 = Brep(extr_8)
preview = CustomPreview(Geometry=[slab_array, slab_gf], Material=ColourSwatch(SwatchColor=RGB(232, 153, 223)))
preview_2 = CustomPreview(Geometry=beam_array, Material=ColourSwatch(SwatchColor=RGB(156, 222, 135)))
preview_3 = CustomPreview(Geometry=column_array, Material=ColourSwatch(SwatchColor=RGB(255, 255, 255)))
preview_4 = CustomPreview(Geometry=glass_array, Material=ColourSwatch(SwatchColor=RGBA(153, 199, 232, 118)))
preview_5 = CustomPreview(Geometry=brep_2, Material=ColourSwatch(SwatchColor=RGB(194, 110, 135)))
volume = Volume(Geometry=flatten(slab_gf))  # -> Volume, Centroid
volume_2 = Volume(Geometry=flatten(column_array))  # -> Volume, Centroid
volume_3 = Volume(Geometry=flatten(beam_array))  # -> Volume, Centroid
volume_4 = Volume(Geometry=flatten(slab_array))  # -> Volume, Centroid
ma = MassAddition(Input=volume.Volume)  # -> Result, PartialResults
volume_5 = Volume(Geometry=flatten(glass_array))  # -> Volume, Centroid
volume_6 = Volume(Geometry=flatten(brep_2))  # -> Volume, Centroid
ma_2 = MassAddition(Input=volume_2.Volume)  # -> Result, PartialResults
ma_3 = MassAddition(Input=volume_3.Volume)  # -> Result, PartialResults
ma_4 = MassAddition(Input=volume_4.Volume)  # -> Result, PartialResults
panel = Panel(ma.Result)
ma_5 = MassAddition(Input=volume_5.Volume)  # -> Result, PartialResults
ma_6 = MassAddition(Input=volume_6.Volume)  # -> Result, PartialResults
panel_2 = Panel(ma_2.Result)
panel_3 = Panel(ma_3.Result)
panel_4 = Panel(ma_4.Result)
panel_5 = Panel(ma_5.Result)
panel_6 = Panel(ma_6.Result)
